# Grasshopper definition Information_Desk.gh (Grasshopper 1.0.8)
# Information Desk modular desk. Native Grasshopper components only. Units: mm.

# ---- group: 01 Overall size - mm
# Read first: Information Desk / NATIVE CONFIGURATOR
# X = left to right; Y = front to back
# All dimensions in mm; heights from floor
# 0 empty | 1 cabinet | 2 low display | 3 tall shelf
# Shared frame is a separate kit of parts.
# Steel shown as section envelopes; joints pending.
width = Slider(3048, range=2000..4000)
depth = Slider(1828.8, range=1450..2600)
overall_height = Slider(2800, range=2200..3200)
columns = Slider(3, range=2..3)
rows = Slider(3, range=2..3)
counter_height = Slider(915, range=760..1100)
frame_section = Slider(40, range=30..60)
shelf_depth = Slider(300, range=150..450)

# ---- group: 02 Move the MD handles to split the grid
# Cuts: Stream Filter selects the active MD data:
# 2 cells = A; 3 cells = A + B.
# Width and depth switch independently.
# 2 cells: Free MD / 1:1 / 1:2 / 2:1
# Ratios locate cuts across the full footprint.
# Minimum bay: X 450 / Y 420 mm.
# Crossed handles are sorted; tight bays clamped.
cut_a = MDSlider(
    SliderMode=0,
    slider_value=Point(0.3333333333, 0.33, 0),
    x_domain=Domain(0, 1),
    y_domain=Domain(0, 1),
    z_domain=Domain(0, 1))
cut_b = MDSlider(
    SliderMode=0,
    slider_value=Point(0.6666666667, 0.77, 0),
    x_domain=Domain(0, 1),
    y_domain=Domain(0, 1),
    z_domain=Domain(0, 1))
depoint = DeconstructPoint(Point=cut_a, System=PlaneXY(0, 0, 0))  # -> XCoordinate, YCoordinate, ZCoordinate
depoint_2 = DeconstructPoint(Point=cut_b, System=PlaneXY(0, 0, 0))  # -> XCoordinate, YCoordinate, ZCoordinate
width_split = ValueList({"Free MD": 0, "1 : 1": 1, "1 : 2": 2, "2 : 1": 3}, selected="Free MD")
depth_split = ValueList({"Free MD": 0, "1 : 1": 1, "1 : 2": 2, "2 : 1": 3}, selected="Free MD")

# ---- group: 03 M11 controls
m11_type = ValueList({"0 Empty": 0, "1 Cabinet": 1, "2 Display": 2, "3 Tall shelf": 3}, selected="2 Display")
m11_shelf_count = Slider(1, range=0..6)
m11_first_shelf = Slider(350, range=250..2450)
m11_last_shelf = Slider(650, range=250..2550)

# ---- group: 03 M21 controls
m21_type = ValueList({"0 Empty": 0, "1 Cabinet": 1, "2 Display": 2, "3 Tall shelf": 3}, selected="2 Display")
m21_shelf_count = Slider(1, range=0..6)
m21_first_shelf = Slider(350, range=250..2450)
m21_last_shelf = Slider(650, range=250..2550)

# ---- group: 03 M31 controls
m31_type = ValueList({"0 Empty": 0, "1 Cabinet": 1, "2 Display": 2, "3 Tall shelf": 3}, selected="1 Cabinet")
m31_shelf_count = Slider(0, range=0..6)
m31_first_shelf = Slider(350, range=250..2450)
m31_last_shelf = Slider(650, range=250..2550)

# ---- group: 03 M12 controls
m12_type = ValueList({"0 Empty": 0, "1 Cabinet": 1, "2 Display": 2, "3 Tall shelf": 3}, selected="0 Empty")
m12_shelf_count = Slider(0, range=0..6)
m12_first_shelf = Slider(350, range=250..2450)
m12_last_shelf = Slider(650, range=250..2550)

# ---- group: 03 M22 controls
m22_type = ValueList({"0 Empty": 0, "1 Cabinet": 1, "2 Display": 2, "3 Tall shelf": 3}, selected="0 Empty")
m22_shelf_count = Slider(0, range=0..6)
m22_first_shelf = Slider(350, range=250..2450)
m22_last_shelf = Slider(650, range=250..2550)

# ---- group: 03 M32 controls
m32_type = ValueList({"0 Empty": 0, "1 Cabinet": 1, "2 Display": 2, "3 Tall shelf": 3}, selected="0 Empty")
m32_shelf_count = Slider(0, range=0..6)
m32_first_shelf = Slider(350, range=250..2450)
m32_last_shelf = Slider(650, range=250..2550)

# ---- group: 03 M13 controls
m13_type = ValueList({"0 Empty": 0, "1 Cabinet": 1, "2 Display": 2, "3 Tall shelf": 3}, selected="3 Tall shelf")
m13_shelf_count = Slider(3, range=0..6)
m13_first_shelf = Slider(1180, range=250..2450)
m13_last_shelf = Slider(2200, range=250..2550)

# ---- group: 03 M23 controls
m23_type = ValueList({"0 Empty": 0, "1 Cabinet": 1, "2 Display": 2, "3 Tall shelf": 3}, selected="3 Tall shelf")
m23_shelf_count = Slider(3, range=0..6)
m23_first_shelf = Slider(1180, range=250..2450)
m23_last_shelf = Slider(2200, range=250..2550)

# ---- group: 03 M33 controls
m33_type = ValueList({"0 Empty": 0, "1 Cabinet": 1, "2 Display": 2, "3 Tall shelf": 3}, selected="3 Tall shelf")
m33_shelf_count = Slider(3, range=0..6)
m33_first_shelf = Slider(1180, range=250..2450)
m33_last_shelf = Slider(2200, range=250..2550)

# ---- group: 04 Grid dimensions - native expressions
num = Number(0)
num_2 = Number(1)
num_3 = Number(450)
num_4 = Number(420)
num_5 = Number(2)
num_6 = Number(152.2672356)
num_7 = Number(-25)
num_8 = Number(170.2672356)
expression = Expression(t=frame_section, Expression="t/2")
expression_2 = Expression(t=frame_section, Expression="-t/2")
width_a_b = Merge(Data1=[depoint.XCoordinate, depoint_2.XCoordinate])
expression_3 = Expression(n=columns, Expression="n-2")
width_md_filter = StreamFilter(Gate=expression_3, Stream0=depoint.XCoordinate, Stream1=width_a_b)
item = ListItem(List=width_md_filter, Index=num, Wrap=num_2)
item_2 = ListItem(List=width_md_filter, Index=num_2, Wrap=num_2)
expression_4 = Expression(n=columns, p=width_split, a=item, Expression="if(n<2.5,if(p<0.5,a,if(p<1.5,0.5,if(p<2.5,1/3,2/3))),a)")
expression_5 = Expression(
    n=columns,
    w=width,
    m=num_3,
    a=expression_4,
    b=item_2,
    t=frame_section,
    Expression="if(n<2.5,max(m+t/2,min(w-t/2-m,a*w)),max(m+t/2,min(w-t/2-2*m,min(a,b)*w)))")
expression_6 = Expression(
    n=columns,
    w=width,
    t=frame_section,
    a=expression_5,
    m=num_3,
    u=expression_4,
    v=item_2,
    Expression="if(n<2.5,w-t/2,max(a+m,min(w-t/2-m,max(u,v)*w)))")
expression_7 = Expression(n=columns, w=width, m=num_3, t=frame_section, Expression="if(n<2.5,w+m,w-t/2)")
depth_a_b = Merge(Data1=[depoint.YCoordinate, depoint_2.YCoordinate])
expression_8 = Expression(n=rows, Expression="n-2")
depth_md_filter = StreamFilter(Gate=expression_8, Stream0=depoint.YCoordinate, Stream1=depth_a_b)
item_3 = ListItem(List=depth_md_filter, Index=num, Wrap=num_2)
item_4 = ListItem(List=depth_md_filter, Index=num_2, Wrap=num_2)
expression_9 = Expression(n=rows, p=depth_split, a=item_3, Expression="if(n<2.5,if(p<0.5,a,if(p<1.5,0.5,if(p<2.5,1/3,2/3))),a)")
expression_10 = Expression(
    n=rows,
    w=depth,
    m=num_4,
    a=expression_9,
    b=item_4,
    t=frame_section,
    Expression="if(n<2.5,max(m+t/2,min(w-t/2-m,a*w)),max(m+t/2,min(w-t/2-2*m,min(a,b)*w)))")
expression_11 = Expression(
    n=rows,
    w=depth,
    t=frame_section,
    a=expression_10,
    m=num_4,
    u=expression_9,
    v=item_4,
    Expression="if(n<2.5,w-t/2,max(a+m,min(w-t/2-m,max(u,v)*w)))")
expression_12 = Expression(n=rows, w=depth, m=num_4, t=frame_section, Expression="if(n<2.5,w+m,w-t/2)")
m11_active = Expression(nx=columns, ny=rows, i=num, j=num, k=m11_type, Expression="if(nx>i,if(ny>j,if(k>0,1,0),0),0)")
m21_active = Expression(nx=columns, ny=rows, i=num_2, j=num, k=m21_type, Expression="if(nx>i,if(ny>j,if(k>0,1,0),0),0)")
m31_active = Expression(nx=columns, ny=rows, i=num_5, j=num, k=m31_type, Expression="if(nx>i,if(ny>j,if(k>0,1,0),0),0)")
m12_active = Expression(nx=columns, ny=rows, i=num, j=num_2, k=m12_type, Expression="if(nx>i,if(ny>j,if(k>0,1,0),0),0)")
m22_active = Expression(nx=columns, ny=rows, i=num_2, j=num_2, k=m22_type, Expression="if(nx>i,if(ny>j,if(k>0,1,0),0),0)")
m32_active = Expression(nx=columns, ny=rows, i=num_5, j=num_2, k=m32_type, Expression="if(nx>i,if(ny>j,if(k>0,1,0),0),0)")
m13_active = Expression(nx=columns, ny=rows, i=num, j=num_5, k=m13_type, Expression="if(nx>i,if(ny>j,if(k>0,1,0),0),0)")
m23_active = Expression(nx=columns, ny=rows, i=num_2, j=num_5, k=m23_type, Expression="if(nx>i,if(ny>j,if(k>0,1,0),0),0)")
m33_active = Expression(nx=columns, ny=rows, i=num_5, j=num_5, k=m33_type, Expression="if(nx>i,if(ny>j,if(k>0,1,0),0),0)")
expression_13 = Expression(a=frame_section, b=num_6, Expression="a+b")
dom = ConstructDomain(DomainStart=num_6, DomainEnd=expression_13)
expression_14 = Expression(h=counter_height, t=frame_section, Expression="h-t")
dom_2 = ConstructDomain(DomainStart=expression_14, DomainEnd=counter_height)
expression_15 = Expression(h=overall_height, t=frame_section, Expression="h-t")
dom_3 = ConstructDomain(DomainStart=expression_15, DomainEnd=overall_height)
dom_4 = ConstructDomain(DomainStart=num_6, DomainEnd=counter_height)
dom_5 = ConstructDomain(DomainStart=counter_height, DomainEnd=overall_height)
expression_16 = Expression(a=counter_height, b=num_7, Expression="a+b")
dom_6 = ConstructDomain(DomainStart=expression_16, DomainEnd=counter_height)
expression_17 = Expression(a=frame_section, b=num_6, Expression="a+b")
expression_18 = Expression(a=frame_section, b=num_8, Expression="a+b")
dom_7 = ConstructDomain(DomainStart=expression_17, DomainEnd=expression_18)

# ---- group: 07 M11 panels and shelves
num_9 = Number(-28)
num_10 = Number(18)
num_11 = Number(-18)
num_12 = Number(-1.5)
num_13 = Number(1.5)
num_14 = Number(-21)
num_15 = Number(-12)
num_16 = Number(3)
num_17 = Number(80)
expression_19 = Expression(x=expression, t=frame_section, Expression="x+t/2+3")
expression_20 = Expression(x=expression_5, t=frame_section, Expression="x-t/2-3")
expression_21 = Expression(y=expression, t=frame_section, Expression="y+t/2+3")
expression_22 = Expression(y=expression_10, t=frame_section, Expression="y-t/2-3")
dom_8 = ConstructDomain(DomainStart=expression_19, DomainEnd=expression_20)
dom_9 = ConstructDomain(DomainStart=expression_21, DomainEnd=expression_22)
box = DomainBox(Base=PlaneXY(0, 0, 0), X=dom_8, Y=dom_9, Z=dom_6)
dispatch = Dispatch(List=box, DispatchPattern=m11_active)  # -> ListA, ListB
box_2 = DomainBox(Base=PlaneXY(0, 0, 0), X=dom_8, Y=dom_9, Z=dom_7)
dispatch_2 = Dispatch(List=box_2, DispatchPattern=m11_active)  # -> ListA, ListB
expression_23 = Expression(a=frame_section, b=num_8, Expression="a+b")
expression_24 = Expression(a=counter_height, b=num_9, Expression="a+b")
dom_10 = ConstructDomain(DomainStart=expression_23, DomainEnd=expression_24)
expression_25 = Expression(a=expression_19, b=num_10, Expression="a+b")
dom_11 = ConstructDomain(DomainStart=expression_19, DomainEnd=expression_25)
box_3 = DomainBox(Base=PlaneXY(0, 0, 0), X=dom_11, Y=dom_9, Z=dom_10)
dispatch_3 = Dispatch(List=box_3, DispatchPattern=m11_active)  # -> ListA, ListB
expression_26 = Expression(a=expression_20, b=num_11, Expression="a+b")
dom_12 = ConstructDomain(DomainStart=expression_26, DomainEnd=expression_20)
box_4 = DomainBox(Base=PlaneXY(0, 0, 0), X=dom_12, Y=dom_9, Z=dom_10)
dispatch_4 = Dispatch(List=box_4, DispatchPattern=m11_active)  # -> ListA, ListB
expression_27 = Expression(a=expression_19, b=num_10, Expression="a+b")
expression_28 = Expression(a=expression_20, b=num_11, Expression="a+b")
dom_13 = ConstructDomain(DomainStart=expression_27, DomainEnd=expression_28)
expression_29 = Expression(a=m11_active, k=m11_type, Expression="a*if(k<1.5,1,if(k>2.5,1,0))")
expression_30 = Expression(a=expression_21, b=num_10, Expression="a+b")
dom_14 = ConstructDomain(DomainStart=expression_21, DomainEnd=expression_30)
box_5 = DomainBox(Base=PlaneXY(0, 0, 0), X=dom_13, Y=dom_14, Z=dom_10)
dispatch_5 = Dispatch(List=box_5, DispatchPattern=expression_29)  # -> ListA, ListB
expression_31 = Expression(a=expression_19, b=expression_20, Expression="(a+b)/2")
expression_32 = Expression(a=expression_19, b=num_10, Expression="a+b")
expression_33 = Expression(a=expression_31, b=num_12, Expression="a+b")
dom_15 = ConstructDomain(DomainStart=expression_32, DomainEnd=expression_33)
expression_34 = Expression(a=expression_22, b=num_11, Expression="a+b")
dom_16 = ConstructDomain(DomainStart=expression_34, DomainEnd=expression_22)
box_6 = DomainBox(Base=PlaneXY(0, 0, 0), X=dom_15, Y=dom_16, Z=dom_10)
dispatch_6 = Dispatch(List=box_6, DispatchPattern=m11_active)  # -> ListA, ListB
expression_35 = Expression(a=expression_31, b=num_13, Expression="a+b")
expression_36 = Expression(a=expression_20, b=num_11, Expression="a+b")
dom_17 = ConstructDomain(DomainStart=expression_35, DomainEnd=expression_36)
expression_37 = Expression(a=expression_22, b=num_11, Expression="a+b")
dom_18 = ConstructDomain(DomainStart=expression_37, DomainEnd=expression_22)
box_7 = DomainBox(Base=PlaneXY(0, 0, 0), X=dom_17, Y=dom_18, Z=dom_10)
dispatch_7 = Dispatch(List=box_7, DispatchPattern=m11_active)  # -> ListA, ListB
expression_38 = Expression(a=m11_active, k=m11_type, Expression="a*if(k>2.5,1,0)")
expression_39 = Expression(a=m11_active, k=m11_type, n=m11_shelf_count, Expression="a*if(k>1.5,if(n>0,1,0),0)")
expression_40 = Expression(k=m11_type, c=counter_height, b=num_6, t=frame_section, Expression="if(k>2.5,c+100,b+t+60)")
expression_41 = Expression(k=m11_type, h=overall_height, c=counter_height, Expression="if(k>2.5,h-400,c-50)")
expression_42 = Expression(
    lo=expression_40,
    hi=expression_41,
    n=m11_shelf_count,
    a=m11_first_shelf,
    b=m11_last_shelf,
    Expression="max(lo,min(hi-40*max(n-1,0),min(a,b)))")
expression_43 = Expression(
    lo=expression_42,
    hi=expression_41,
    n=m11_shelf_count,
    a=m11_first_shelf,
    b=m11_last_shelf,
    Expression="max(lo+40*max(n-1,0),min(hi,max(a,b)))")
expression_44 = Expression(n=m11_shelf_count, Expression="max(1,n)")
series = Series(Start=num, Step=num_2, Count=expression_44)
m11_shelf_levels = Expression(n=m11_shelf_count, a=expression_42, b=expression_43, i=series, Expression="if(n<1.5,a,a+(b-a)*i/max(1,n-1))")
expression_45 = Expression(a=expression_21, b=expression_22, d=shelf_depth, Expression="max(a+21,b-d-21)")
expression_46 = Expression(a=expression_19, b=num_10, Expression="a+b")
expression_47 = Expression(a=expression_20, b=num_11, Expression="a+b")
dom_19 = ConstructDomain(DomainStart=expression_46, DomainEnd=expression_47)
expression_48 = Expression(a=expression_22, b=num_14, Expression="a+b")
dom_20 = ConstructDomain(DomainStart=expression_45, DomainEnd=expression_48)
expression_49 = Expression(a=m11_shelf_levels, b=num_11, Expression="a+b")
dom_21 = ConstructDomain(DomainStart=expression_49, DomainEnd=m11_shelf_levels)
box_8 = DomainBox(Base=PlaneXY(0, 0, 0), X=dom_19, Y=dom_20, Z=dom_21)
dispatch_8 = Dispatch(List=box_8, DispatchPattern=expression_39)  # -> ListA, ListB
expression_50 = Expression(a=expression_22, b=num_15, Expression="a+b")
dom_22 = ConstructDomain(DomainStart=expression_50, DomainEnd=expression_22)
expression_51 = Expression(a=counter_height, b=num_16, Expression="a+b")
expression_52 = Expression(a=expression_43, b=num_17, Expression="a+b")
dom_23 = ConstructDomain(DomainStart=expression_51, DomainEnd=expression_52)
box_9 = DomainBox(Base=PlaneXY(0, 0, 0), X=dom_8, Y=dom_22, Z=dom_23)
dispatch_9 = Dispatch(List=box_9, DispatchPattern=expression_38)  # -> ListA, ListB
expression_53 = Expression(a=expression, b=expression_5, Expression="b-a")
expression_54 = Expression(a=expression, b=expression_10, Expression="b-a")
pt = ConstructPoint(XCoordinate=expression_53, YCoordinate=expression_54, ZCoordinate=counter_height)
dispatch_10 = Dispatch(List=pt, DispatchPattern=m11_active)  # -> ListA, ListB

# ---- group: 05 One frame member per grid edge
expression_55 = Expression(a=expression, b=expression_2, Expression="a+b")
expression_56 = Expression(a=expression, b=expression, Expression="a+b")
dom_24 = ConstructDomain(DomainStart=expression_55, DomainEnd=expression_56)
expression_57 = Expression(a=expression_5, b=expression_2, Expression="a+b")
expression_58 = Expression(a=expression_5, b=expression, Expression="a+b")
dom_25 = ConstructDomain(DomainStart=expression_57, DomainEnd=expression_58)
expression_59 = Expression(a=expression_6, b=expression_2, Expression="a+b")
expression_60 = Expression(a=expression_6, b=expression, Expression="a+b")
dom_26 = ConstructDomain(DomainStart=expression_59, DomainEnd=expression_60)
expression_61 = Expression(a=expression_7, b=expression_2, Expression="a+b")
expression_62 = Expression(a=expression_7, b=expression, Expression="a+b")
dom_27 = ConstructDomain(DomainStart=expression_61, DomainEnd=expression_62)
expression_63 = Expression(a=expression, b=expression_2, Expression="a+b")
expression_64 = Expression(a=expression, b=expression, Expression="a+b")
dom_28 = ConstructDomain(DomainStart=expression_63, DomainEnd=expression_64)
expression_65 = Expression(a=expression_10, b=expression_2, Expression="a+b")
expression_66 = Expression(a=expression_10, b=expression, Expression="a+b")
dom_29 = ConstructDomain(DomainStart=expression_65, DomainEnd=expression_66)
expression_67 = Expression(a=expression_11, b=expression_2, Expression="a+b")
expression_68 = Expression(a=expression_11, b=expression, Expression="a+b")
dom_30 = ConstructDomain(DomainStart=expression_67, DomainEnd=expression_68)
expression_69 = Expression(a=expression_12, b=expression_2, Expression="a+b")
expression_70 = Expression(a=expression_12, b=expression, Expression="a+b")
dom_31 = ConstructDomain(DomainStart=expression_69, DomainEnd=expression_70)
expression_71 = Expression(a=expression, b=expression, Expression="a+b")
expression_72 = Expression(a=expression_5, b=expression_2, Expression="a+b")
dom_32 = ConstructDomain(DomainStart=expression_71, DomainEnd=expression_72)
expression_73 = Expression(a=expression, b=expression, Expression="a+b")
expression_74 = Expression(a=expression_10, b=expression_2, Expression="a+b")
dom_33 = ConstructDomain(DomainStart=expression_73, DomainEnd=expression_74)
expression_75 = Expression(a=expression_5, b=expression, Expression="a+b")
expression_76 = Expression(a=expression_6, b=expression_2, Expression="a+b")
dom_34 = ConstructDomain(DomainStart=expression_75, DomainEnd=expression_76)
expression_77 = Expression(a=expression_10, b=expression, Expression="a+b")
expression_78 = Expression(a=expression_11, b=expression_2, Expression="a+b")
dom_35 = ConstructDomain(DomainStart=expression_77, DomainEnd=expression_78)
expression_79 = Expression(a=expression_6, b=expression, Expression="a+b")
expression_80 = Expression(a=expression_7, b=expression_2, Expression="a+b")
dom_36 = ConstructDomain(DomainStart=expression_79, DomainEnd=expression_80)
expression_81 = Expression(a=expression_11, b=expression, Expression="a+b")
expression_82 = Expression(a=expression_12, b=expression_2, Expression="a+b")
dom_37 = ConstructDomain(DomainStart=expression_81, DomainEnd=expression_82)
node_00 = Expression(a=m11_active, Expression="if(a>0,1,0)")
box_10 = DomainBox(Base=PlaneXY(0, 0, 0), X=dom_24, Y=dom_28, Z=dom_4)
dispatch_11 = Dispatch(List=box_10, DispatchPattern=node_00)  # -> ListA, ListB
box_11 = DomainBox(Base=PlaneXY(0, 0, 0), X=dom_24, Y=dom_28, Z=dom_5)
dispatch_12 = Dispatch(List=box_11, DispatchPattern=node_00)  # -> ListA, ListB
node_10 = Expression(a=m11_active, b=m21_active, Expression="if(a+b>0,1,0)")
box_12 = DomainBox(Base=PlaneXY(0, 0, 0), X=dom_25, Y=dom_28, Z=dom_4)
dispatch_13 = Dispatch(List=box_12, DispatchPattern=node_10)  # -> ListA, ListB
box_13 = DomainBox(Base=PlaneXY(0, 0, 0), X=dom_25, Y=dom_28, Z=dom_5)
dispatch_14 = Dispatch(List=box_13, DispatchPattern=node_10)  # -> ListA, ListB
node_20 = Expression(a=m21_active, b=m31_active, Expression="if(a+b>0,1,0)")
box_14 = DomainBox(Base=PlaneXY(0, 0, 0), X=dom_26, Y=dom_28, Z=dom_4)
dispatch_15 = Dispatch(List=box_14, DispatchPattern=node_20)  # -> ListA, ListB
box_15 = DomainBox(Base=PlaneXY(0, 0, 0), X=dom_26, Y=dom_28, Z=dom_5)
dispatch_16 = Dispatch(List=box_15, DispatchPattern=node_20)  # -> ListA, ListB
node_30 = Expression(a=m31_active, Expression="if(a>0,1,0)")
box_16 = DomainBox(Base=PlaneXY(0, 0, 0), X=dom_27, Y=dom_28, Z=dom_4)
dispatch_17 = Dispatch(List=box_16, DispatchPattern=node_30)  # -> ListA, ListB
box_17 = DomainBox(Base=PlaneXY(0, 0, 0), X=dom_27, Y=dom_28, Z=dom_5)
dispatch_18 = Dispatch(List=box_17, DispatchPattern=node_30)  # -> ListA, ListB
node_01 = Expression(a=m11_active, b=m12_active, Expression="if(a+b>0,1,0)")
box_18 = DomainBox(Base=PlaneXY(0, 0, 0), X=dom_24, Y=dom_29, Z=dom_4)
dispatch_19 = Dispatch(List=box_18, DispatchPattern=node_01)  # -> ListA, ListB
box_19 = DomainBox(Base=PlaneXY(0, 0, 0), X=dom_24, Y=dom_29, Z=dom_5)
dispatch_20 = Dispatch(List=box_19, DispatchPattern=node_01)  # -> ListA, ListB
node_11 = Expression(a=m11_active, b=m21_active, c=m12_active, d=m22_active, Expression="if(a+b+c+d>0,1,0)")
box_20 = DomainBox(Base=PlaneXY(0, 0, 0), X=dom_25, Y=dom_29, Z=dom_4)
dispatch_21 = Dispatch(List=box_20, DispatchPattern=node_11)  # -> ListA, ListB
box_21 = DomainBox(Base=PlaneXY(0, 0, 0), X=dom_25, Y=dom_29, Z=dom_5)
dispatch_22 = Dispatch(List=box_21, DispatchPattern=node_11)  # -> ListA, ListB
node_21 = Expression(a=m21_active, b=m31_active, c=m22_active, d=m32_active, Expression="if(a+b+c+d>0,1,0)")
box_22 = DomainBox(Base=PlaneXY(0, 0, 0), X=dom_26, Y=dom_29, Z=dom_4)
dispatch_23 = Dispatch(List=box_22, DispatchPattern=node_21)  # -> ListA, ListB
box_23 = DomainBox(Base=PlaneXY(0, 0, 0), X=dom_26, Y=dom_29, Z=dom_5)
dispatch_24 = Dispatch(List=box_23, DispatchPattern=node_21)  # -> ListA, ListB
node_31 = Expression(a=m31_active, b=m32_active, Expression="if(a+b>0,1,0)")
box_24 = DomainBox(Base=PlaneXY(0, 0, 0), X=dom_27, Y=dom_29, Z=dom_4)
dispatch_25 = Dispatch(List=box_24, DispatchPattern=node_31)  # -> ListA, ListB
box_25 = DomainBox(Base=PlaneXY(0, 0, 0), X=dom_27, Y=dom_29, Z=dom_5)
dispatch_26 = Dispatch(List=box_25, DispatchPattern=node_31)  # -> ListA, ListB
node_02 = Expression(a=m12_active, b=m13_active, Expression="if(a+b>0,1,0)")
box_26 = DomainBox(Base=PlaneXY(0, 0, 0), X=dom_24, Y=dom_30, Z=dom_4)
dispatch_27 = Dispatch(List=box_26, DispatchPattern=node_02)  # -> ListA, ListB
box_27 = DomainBox(Base=PlaneXY(0, 0, 0), X=dom_24, Y=dom_30, Z=dom_5)
dispatch_28 = Dispatch(List=box_27, DispatchPattern=node_02)  # -> ListA, ListB
node_12 = Expression(a=m12_active, b=m22_active, c=m13_active, d=m23_active, Expression="if(a+b+c+d>0,1,0)")
box_28 = DomainBox(Base=PlaneXY(0, 0, 0), X=dom_25, Y=dom_30, Z=dom_4)
dispatch_29 = Dispatch(List=box_28, DispatchPattern=node_12)  # -> ListA, ListB
box_29 = DomainBox(Base=PlaneXY(0, 0, 0), X=dom_25, Y=dom_30, Z=dom_5)
dispatch_30 = Dispatch(List=box_29, DispatchPattern=node_12)  # -> ListA, ListB
node_22 = Expression(a=m22_active, b=m32_active, c=m23_active, d=m33_active, Expression="if(a+b+c+d>0,1,0)")
box_30 = DomainBox(Base=PlaneXY(0, 0, 0), X=dom_26, Y=dom_30, Z=dom_4)
dispatch_31 = Dispatch(List=box_30, DispatchPattern=node_22)  # -> ListA, ListB
box_31 = DomainBox(Base=PlaneXY(0, 0, 0), X=dom_26, Y=dom_30, Z=dom_5)
dispatch_32 = Dispatch(List=box_31, DispatchPattern=node_22)  # -> ListA, ListB
node_32 = Expression(a=m32_active, b=m33_active, Expression="if(a+b>0,1,0)")
box_32 = DomainBox(Base=PlaneXY(0, 0, 0), X=dom_27, Y=dom_30, Z=dom_4)
dispatch_33 = Dispatch(List=box_32, DispatchPattern=node_32)  # -> ListA, ListB
box_33 = DomainBox(Base=PlaneXY(0, 0, 0), X=dom_27, Y=dom_30, Z=dom_5)
dispatch_34 = Dispatch(List=box_33, DispatchPattern=node_32)  # -> ListA, ListB
node_03 = Expression(a=m13_active, Expression="if(a>0,1,0)")
box_34 = DomainBox(Base=PlaneXY(0, 0, 0), X=dom_24, Y=dom_31, Z=dom_4)
dispatch_35 = Dispatch(List=box_34, DispatchPattern=node_03)  # -> ListA, ListB
box_35 = DomainBox(Base=PlaneXY(0, 0, 0), X=dom_24, Y=dom_31, Z=dom_5)
dispatch_36 = Dispatch(List=box_35, DispatchPattern=node_03)  # -> ListA, ListB
node_13 = Expression(a=m13_active, b=m23_active, Expression="if(a+b>0,1,0)")
box_36 = DomainBox(Base=PlaneXY(0, 0, 0), X=dom_25, Y=dom_31, Z=dom_4)
dispatch_37 = Dispatch(List=box_36, DispatchPattern=node_13)  # -> ListA, ListB
box_37 = DomainBox(Base=PlaneXY(0, 0, 0), X=dom_25, Y=dom_31, Z=dom_5)
dispatch_38 = Dispatch(List=box_37, DispatchPattern=node_13)  # -> ListA, ListB
node_23 = Expression(a=m23_active, b=m33_active, Expression="if(a+b>0,1,0)")
box_38 = DomainBox(Base=PlaneXY(0, 0, 0), X=dom_26, Y=dom_31, Z=dom_4)
dispatch_39 = Dispatch(List=box_38, DispatchPattern=node_23)  # -> ListA, ListB
box_39 = DomainBox(Base=PlaneXY(0, 0, 0), X=dom_26, Y=dom_31, Z=dom_5)
dispatch_40 = Dispatch(List=box_39, DispatchPattern=node_23)  # -> ListA, ListB
node_33 = Expression(a=m33_active, Expression="if(a>0,1,0)")
box_40 = DomainBox(Base=PlaneXY(0, 0, 0), X=dom_27, Y=dom_31, Z=dom_4)
dispatch_41 = Dispatch(List=box_40, DispatchPattern=node_33)  # -> ListA, ListB
box_41 = DomainBox(Base=PlaneXY(0, 0, 0), X=dom_27, Y=dom_31, Z=dom_5)
dispatch_42 = Dispatch(List=box_41, DispatchPattern=node_33)  # -> ListA, ListB
expression_83 = Expression(a=m11_active, Expression="if(a>0,1,0)")
box_42 = DomainBox(Base=PlaneXY(0, 0, 0), X=dom_32, Y=dom_28, Z=dom)
dispatch_43 = Dispatch(List=box_42, DispatchPattern=expression_83)  # -> ListA, ListB
box_43 = DomainBox(Base=PlaneXY(0, 0, 0), X=dom_32, Y=dom_28, Z=dom_2)
dispatch_44 = Dispatch(List=box_43, DispatchPattern=expression_83)  # -> ListA, ListB
box_44 = DomainBox(Base=PlaneXY(0, 0, 0), X=dom_32, Y=dom_28, Z=dom_3)
dispatch_45 = Dispatch(List=box_44, DispatchPattern=expression_83)  # -> ListA, ListB
expression_84 = Expression(a=m21_active, Expression="if(a>0,1,0)")
box_45 = DomainBox(Base=PlaneXY(0, 0, 0), X=dom_34, Y=dom_28, Z=dom)
dispatch_46 = Dispatch(List=box_45, DispatchPattern=expression_84)  # -> ListA, ListB
box_46 = DomainBox(Base=PlaneXY(0, 0, 0), X=dom_34, Y=dom_28, Z=dom_2)
dispatch_47 = Dispatch(List=box_46, DispatchPattern=expression_84)  # -> ListA, ListB
box_47 = DomainBox(Base=PlaneXY(0, 0, 0), X=dom_34, Y=dom_28, Z=dom_3)
dispatch_48 = Dispatch(List=box_47, DispatchPattern=expression_84)  # -> ListA, ListB
expression_85 = Expression(a=m31_active, Expression="if(a>0,1,0)")
box_48 = DomainBox(Base=PlaneXY(0, 0, 0), X=dom_36, Y=dom_28, Z=dom)
dispatch_49 = Dispatch(List=box_48, DispatchPattern=expression_85)  # -> ListA, ListB
box_49 = DomainBox(Base=PlaneXY(0, 0, 0), X=dom_36, Y=dom_28, Z=dom_2)
dispatch_50 = Dispatch(List=box_49, DispatchPattern=expression_85)  # -> ListA, ListB
box_50 = DomainBox(Base=PlaneXY(0, 0, 0), X=dom_36, Y=dom_28, Z=dom_3)
dispatch_51 = Dispatch(List=box_50, DispatchPattern=expression_85)  # -> ListA, ListB
expression_86 = Expression(a=m11_active, b=m12_active, Expression="if(a+b>0,1,0)")
box_51 = DomainBox(Base=PlaneXY(0, 0, 0), X=dom_32, Y=dom_29, Z=dom)
dispatch_52 = Dispatch(List=box_51, DispatchPattern=expression_86)  # -> ListA, ListB
box_52 = DomainBox(Base=PlaneXY(0, 0, 0), X=dom_32, Y=dom_29, Z=dom_2)
dispatch_53 = Dispatch(List=box_52, DispatchPattern=expression_86)  # -> ListA, ListB
box_53 = DomainBox(Base=PlaneXY(0, 0, 0), X=dom_32, Y=dom_29, Z=dom_3)
dispatch_54 = Dispatch(List=box_53, DispatchPattern=expression_86)  # -> ListA, ListB
expression_87 = Expression(a=m21_active, b=m22_active, Expression="if(a+b>0,1,0)")
box_54 = DomainBox(Base=PlaneXY(0, 0, 0), X=dom_34, Y=dom_29, Z=dom)
dispatch_55 = Dispatch(List=box_54, DispatchPattern=expression_87)  # -> ListA, ListB
box_55 = DomainBox(Base=PlaneXY(0, 0, 0), X=dom_34, Y=dom_29, Z=dom_2)
dispatch_56 = Dispatch(List=box_55, DispatchPattern=expression_87)  # -> ListA, ListB
box_56 = DomainBox(Base=PlaneXY(0, 0, 0), X=dom_34, Y=dom_29, Z=dom_3)
dispatch_57 = Dispatch(List=box_56, DispatchPattern=expression_87)  # -> ListA, ListB
expression_88 = Expression(a=m31_active, b=m32_active, Expression="if(a+b>0,1,0)")
box_57 = DomainBox(Base=PlaneXY(0, 0, 0), X=dom_36, Y=dom_29, Z=dom)
dispatch_58 = Dispatch(List=box_57, DispatchPattern=expression_88)  # -> ListA, ListB
box_58 = DomainBox(Base=PlaneXY(0, 0, 0), X=dom_36, Y=dom_29, Z=dom_2)
dispatch_59 = Dispatch(List=box_58, DispatchPattern=expression_88)  # -> ListA, ListB
box_59 = DomainBox(Base=PlaneXY(0, 0, 0), X=dom_36, Y=dom_29, Z=dom_3)
dispatch_60 = Dispatch(List=box_59, DispatchPattern=expression_88)  # -> ListA, ListB
expression_89 = Expression(a=m12_active, b=m13_active, Expression="if(a+b>0,1,0)")
box_60 = DomainBox(Base=PlaneXY(0, 0, 0), X=dom_32, Y=dom_30, Z=dom)
dispatch_61 = Dispatch(List=box_60, DispatchPattern=expression_89)  # -> ListA, ListB
box_61 = DomainBox(Base=PlaneXY(0, 0, 0), X=dom_32, Y=dom_30, Z=dom_2)
dispatch_62 = Dispatch(List=box_61, DispatchPattern=expression_89)  # -> ListA, ListB
box_62 = DomainBox(Base=PlaneXY(0, 0, 0), X=dom_32, Y=dom_30, Z=dom_3)
dispatch_63 = Dispatch(List=box_62, DispatchPattern=expression_89)  # -> ListA, ListB
expression_90 = Expression(a=m22_active, b=m23_active, Expression="if(a+b>0,1,0)")
box_63 = DomainBox(Base=PlaneXY(0, 0, 0), X=dom_34, Y=dom_30, Z=dom)
dispatch_64 = Dispatch(List=box_63, DispatchPattern=expression_90)  # -> ListA, ListB
box_64 = DomainBox(Base=PlaneXY(0, 0, 0), X=dom_34, Y=dom_30, Z=dom_2)
dispatch_65 = Dispatch(List=box_64, DispatchPattern=expression_90)  # -> ListA, ListB
box_65 = DomainBox(Base=PlaneXY(0, 0, 0), X=dom_34, Y=dom_30, Z=dom_3)
dispatch_66 = Dispatch(List=box_65, DispatchPattern=expression_90)  # -> ListA, ListB
expression_91 = Expression(a=m32_active, b=m33_active, Expression="if(a+b>0,1,0)")
box_66 = DomainBox(Base=PlaneXY(0, 0, 0), X=dom_36, Y=dom_30, Z=dom)
dispatch_67 = Dispatch(List=box_66, DispatchPattern=expression_91)  # -> ListA, ListB
box_67 = DomainBox(Base=PlaneXY(0, 0, 0), X=dom_36, Y=dom_30, Z=dom_2)
dispatch_68 = Dispatch(List=box_67, DispatchPattern=expression_91)  # -> ListA, ListB
box_68 = DomainBox(Base=PlaneXY(0, 0, 0), X=dom_36, Y=dom_30, Z=dom_3)
dispatch_69 = Dispatch(List=box_68, DispatchPattern=expression_91)  # -> ListA, ListB
expression_92 = Expression(a=m13_active, Expression="if(a>0,1,0)")
box_69 = DomainBox(Base=PlaneXY(0, 0, 0), X=dom_32, Y=dom_31, Z=dom)
dispatch_70 = Dispatch(List=box_69, DispatchPattern=expression_92)  # -> ListA, ListB
box_70 = DomainBox(Base=PlaneXY(0, 0, 0), X=dom_32, Y=dom_31, Z=dom_2)
dispatch_71 = Dispatch(List=box_70, DispatchPattern=expression_92)  # -> ListA, ListB
box_71 = DomainBox(Base=PlaneXY(0, 0, 0), X=dom_32, Y=dom_31, Z=dom_3)
dispatch_72 = Dispatch(List=box_71, DispatchPattern=expression_92)  # -> ListA, ListB
expression_93 = Expression(a=m23_active, Expression="if(a>0,1,0)")
box_72 = DomainBox(Base=PlaneXY(0, 0, 0), X=dom_34, Y=dom_31, Z=dom)
dispatch_73 = Dispatch(List=box_72, DispatchPattern=expression_93)  # -> ListA, ListB
box_73 = DomainBox(Base=PlaneXY(0, 0, 0), X=dom_34, Y=dom_31, Z=dom_2)
dispatch_74 = Dispatch(List=box_73, DispatchPattern=expression_93)  # -> ListA, ListB
box_74 = DomainBox(Base=PlaneXY(0, 0, 0), X=dom_34, Y=dom_31, Z=dom_3)
dispatch_75 = Dispatch(List=box_74, DispatchPattern=expression_93)  # -> ListA, ListB
expression_94 = Expression(a=m33_active, Expression="if(a>0,1,0)")
box_75 = DomainBox(Base=PlaneXY(0, 0, 0), X=dom_36, Y=dom_31, Z=dom)
dispatch_76 = Dispatch(List=box_75, DispatchPattern=expression_94)  # -> ListA, ListB
box_76 = DomainBox(Base=PlaneXY(0, 0, 0), X=dom_36, Y=dom_31, Z=dom_2)
dispatch_77 = Dispatch(List=box_76, DispatchPattern=expression_94)  # -> ListA, ListB
box_77 = DomainBox(Base=PlaneXY(0, 0, 0), X=dom_36, Y=dom_31, Z=dom_3)
dispatch_78 = Dispatch(List=box_77, DispatchPattern=expression_94)  # -> ListA, ListB
expression_95 = Expression(a=m11_active, Expression="if(a>0,1,0)")
box_78 = DomainBox(Base=PlaneXY(0, 0, 0), X=dom_24, Y=dom_33, Z=dom)
dispatch_79 = Dispatch(List=box_78, DispatchPattern=expression_95)  # -> ListA, ListB
box_79 = DomainBox(Base=PlaneXY(0, 0, 0), X=dom_24, Y=dom_33, Z=dom_2)
dispatch_80 = Dispatch(List=box_79, DispatchPattern=expression_95)  # -> ListA, ListB
box_80 = DomainBox(Base=PlaneXY(0, 0, 0), X=dom_24, Y=dom_33, Z=dom_3)
dispatch_81 = Dispatch(List=box_80, DispatchPattern=expression_95)  # -> ListA, ListB
expression_96 = Expression(a=m12_active, Expression="if(a>0,1,0)")
box_81 = DomainBox(Base=PlaneXY(0, 0, 0), X=dom_24, Y=dom_35, Z=dom)
dispatch_82 = Dispatch(List=box_81, DispatchPattern=expression_96)  # -> ListA, ListB
box_82 = DomainBox(Base=PlaneXY(0, 0, 0), X=dom_24, Y=dom_35, Z=dom_2)
dispatch_83 = Dispatch(List=box_82, DispatchPattern=expression_96)  # -> ListA, ListB
box_83 = DomainBox(Base=PlaneXY(0, 0, 0), X=dom_24, Y=dom_35, Z=dom_3)
dispatch_84 = Dispatch(List=box_83, DispatchPattern=expression_96)  # -> ListA, ListB
expression_97 = Expression(a=m13_active, Expression="if(a>0,1,0)")
box_84 = DomainBox(Base=PlaneXY(0, 0, 0), X=dom_24, Y=dom_37, Z=dom)
dispatch_85 = Dispatch(List=box_84, DispatchPattern=expression_97)  # -> ListA, ListB
box_85 = DomainBox(Base=PlaneXY(0, 0, 0), X=dom_24, Y=dom_37, Z=dom_2)
dispatch_86 = Dispatch(List=box_85, DispatchPattern=expression_97)  # -> ListA, ListB
box_86 = DomainBox(Base=PlaneXY(0, 0, 0), X=dom_24, Y=dom_37, Z=dom_3)
dispatch_87 = Dispatch(List=box_86, DispatchPattern=expression_97)  # -> ListA, ListB
expression_98 = Expression(a=m11_active, b=m21_active, Expression="if(a+b>0,1,0)")
box_87 = DomainBox(Base=PlaneXY(0, 0, 0), X=dom_25, Y=dom_33, Z=dom)
dispatch_88 = Dispatch(List=box_87, DispatchPattern=expression_98)  # -> ListA, ListB
box_88 = DomainBox(Base=PlaneXY(0, 0, 0), X=dom_25, Y=dom_33, Z=dom_2)
dispatch_89 = Dispatch(List=box_88, DispatchPattern=expression_98)  # -> ListA, ListB
box_89 = DomainBox(Base=PlaneXY(0, 0, 0), X=dom_25, Y=dom_33, Z=dom_3)
dispatch_90 = Dispatch(List=box_89, DispatchPattern=expression_98)  # -> ListA, ListB
expression_99 = Expression(a=m12_active, b=m22_active, Expression="if(a+b>0,1,0)")
box_90 = DomainBox(Base=PlaneXY(0, 0, 0), X=dom_25, Y=dom_35, Z=dom)
dispatch_91 = Dispatch(List=box_90, DispatchPattern=expression_99)  # -> ListA, ListB
box_91 = DomainBox(Base=PlaneXY(0, 0, 0), X=dom_25, Y=dom_35, Z=dom_2)
dispatch_92 = Dispatch(List=box_91, DispatchPattern=expression_99)  # -> ListA, ListB
box_92 = DomainBox(Base=PlaneXY(0, 0, 0), X=dom_25, Y=dom_35, Z=dom_3)
dispatch_93 = Dispatch(List=box_92, DispatchPattern=expression_99)  # -> ListA, ListB
expression_100 = Expression(a=m13_active, b=m23_active, Expression="if(a+b>0,1,0)")
box_93 = DomainBox(Base=PlaneXY(0, 0, 0), X=dom_25, Y=dom_37, Z=dom)
dispatch_94 = Dispatch(List=box_93, DispatchPattern=expression_100)  # -> ListA, ListB
box_94 = DomainBox(Base=PlaneXY(0, 0, 0), X=dom_25, Y=dom_37, Z=dom_2)
dispatch_95 = Dispatch(List=box_94, DispatchPattern=expression_100)  # -> ListA, ListB
box_95 = DomainBox(Base=PlaneXY(0, 0, 0), X=dom_25, Y=dom_37, Z=dom_3)
dispatch_96 = Dispatch(List=box_95, DispatchPattern=expression_100)  # -> ListA, ListB
expression_101 = Expression(a=m21_active, b=m31_active, Expression="if(a+b>0,1,0)")
box_96 = DomainBox(Base=PlaneXY(0, 0, 0), X=dom_26, Y=dom_33, Z=dom)
dispatch_97 = Dispatch(List=box_96, DispatchPattern=expression_101)  # -> ListA, ListB
box_97 = DomainBox(Base=PlaneXY(0, 0, 0), X=dom_26, Y=dom_33, Z=dom_2)
dispatch_98 = Dispatch(List=box_97, DispatchPattern=expression_101)  # -> ListA, ListB
box_98 = DomainBox(Base=PlaneXY(0, 0, 0), X=dom_26, Y=dom_33, Z=dom_3)
dispatch_99 = Dispatch(List=box_98, DispatchPattern=expression_101)  # -> ListA, ListB
expression_102 = Expression(a=m22_active, b=m32_active, Expression="if(a+b>0,1,0)")
box_99 = DomainBox(Base=PlaneXY(0, 0, 0), X=dom_26, Y=dom_35, Z=dom)
dispatch_100 = Dispatch(List=box_99, DispatchPattern=expression_102)  # -> ListA, ListB
box_100 = DomainBox(Base=PlaneXY(0, 0, 0), X=dom_26, Y=dom_35, Z=dom_2)
dispatch_101 = Dispatch(List=box_100, DispatchPattern=expression_102)  # -> ListA, ListB
box_101 = DomainBox(Base=PlaneXY(0, 0, 0), X=dom_26, Y=dom_35, Z=dom_3)
dispatch_102 = Dispatch(List=box_101, DispatchPattern=expression_102)  # -> ListA, ListB
expression_103 = Expression(a=m23_active, b=m33_active, Expression="if(a+b>0,1,0)")
box_102 = DomainBox(Base=PlaneXY(0, 0, 0), X=dom_26, Y=dom_37, Z=dom)
dispatch_103 = Dispatch(List=box_102, DispatchPattern=expression_103)  # -> ListA, ListB
box_103 = DomainBox(Base=PlaneXY(0, 0, 0), X=dom_26, Y=dom_37, Z=dom_2)
dispatch_104 = Dispatch(List=box_103, DispatchPattern=expression_103)  # -> ListA, ListB
box_104 = DomainBox(Base=PlaneXY(0, 0, 0), X=dom_26, Y=dom_37, Z=dom_3)
dispatch_105 = Dispatch(List=box_104, DispatchPattern=expression_103)  # -> ListA, ListB
expression_104 = Expression(a=m31_active, Expression="if(a>0,1,0)")
box_105 = DomainBox(Base=PlaneXY(0, 0, 0), X=dom_27, Y=dom_33, Z=dom)
dispatch_106 = Dispatch(List=box_105, DispatchPattern=expression_104)  # -> ListA, ListB
box_106 = DomainBox(Base=PlaneXY(0, 0, 0), X=dom_27, Y=dom_33, Z=dom_2)
dispatch_107 = Dispatch(List=box_106, DispatchPattern=expression_104)  # -> ListA, ListB
box_107 = DomainBox(Base=PlaneXY(0, 0, 0), X=dom_27, Y=dom_33, Z=dom_3)
dispatch_108 = Dispatch(List=box_107, DispatchPattern=expression_104)  # -> ListA, ListB
expression_105 = Expression(a=m32_active, Expression="if(a>0,1,0)")
box_108 = DomainBox(Base=PlaneXY(0, 0, 0), X=dom_27, Y=dom_35, Z=dom)
dispatch_109 = Dispatch(List=box_108, DispatchPattern=expression_105)  # -> ListA, ListB
box_109 = DomainBox(Base=PlaneXY(0, 0, 0), X=dom_27, Y=dom_35, Z=dom_2)
dispatch_110 = Dispatch(List=box_109, DispatchPattern=expression_105)  # -> ListA, ListB
box_110 = DomainBox(Base=PlaneXY(0, 0, 0), X=dom_27, Y=dom_35, Z=dom_3)
dispatch_111 = Dispatch(List=box_110, DispatchPattern=expression_105)  # -> ListA, ListB
expression_106 = Expression(a=m33_active, Expression="if(a>0,1,0)")
box_111 = DomainBox(Base=PlaneXY(0, 0, 0), X=dom_27, Y=dom_37, Z=dom)
dispatch_112 = Dispatch(List=box_111, DispatchPattern=expression_106)  # -> ListA, ListB
box_112 = DomainBox(Base=PlaneXY(0, 0, 0), X=dom_27, Y=dom_37, Z=dom_2)
dispatch_113 = Dispatch(List=box_112, DispatchPattern=expression_106)  # -> ListA, ListB
box_113 = DomainBox(Base=PlaneXY(0, 0, 0), X=dom_27, Y=dom_37, Z=dom_3)
dispatch_114 = Dispatch(List=box_113, DispatchPattern=expression_106)  # -> ListA, ListB

# ---- group: 06 Casters and mounting blanks
num_18 = Number(146.2672356)
expression_107 = Expression(a=m11_active, Expression="if(a>0,1,0)")
expression_108 = Expression(a=m11_active, Expression="if(a>0,1,0)")
expression_109 = Expression(x=expression, r=expression_107, l=num, Expression="x+100*(r-l)")
expression_110 = Expression(y=expression, r=expression_108, l=num, Expression="y+100*(r-l)")
pt_2 = ConstructPoint(XCoordinate=expression_109, YCoordinate=expression_110, ZCoordinate=num)
dispatch_115 = Dispatch(List=pt_2, DispatchPattern=node_00)  # -> ListA, ListB
expression_111 = Expression(x=expression, c=expression_109, t=frame_section, Expression="min(x-t/2,c-45)")
expression_112 = Expression(x=expression, c=expression_109, t=frame_section, Expression="max(x+t/2,c+45)")
dom_38 = ConstructDomain(DomainStart=expression_111, DomainEnd=expression_112)
expression_113 = Expression(y=expression, c=expression_110, t=frame_section, Expression="min(y-t/2,c-40)")
expression_114 = Expression(y=expression, c=expression_110, t=frame_section, Expression="max(y+t/2,c+40)")
dom_39 = ConstructDomain(DomainStart=expression_113, DomainEnd=expression_114)
dom_40 = ConstructDomain(DomainStart=num_18, DomainEnd=num_6)
box_114 = DomainBox(Base=PlaneXY(0, 0, 0), X=dom_38, Y=dom_39, Z=dom_40)
dispatch_116 = Dispatch(List=box_114, DispatchPattern=node_00)  # -> ListA, ListB
expression_115 = Expression(a=m11_active, Expression="if(a>0,1,0)")
expression_116 = Expression(a=m21_active, Expression="if(a>0,1,0)")
expression_117 = Expression(a=m11_active, b=m21_active, Expression="if(a+b>0,1,0)")
expression_118 = Expression(x=expression_5, r=expression_116, l=expression_115, Expression="x+100*(r-l)")
expression_119 = Expression(y=expression, r=expression_117, l=num, Expression="y+100*(r-l)")
pt_3 = ConstructPoint(XCoordinate=expression_118, YCoordinate=expression_119, ZCoordinate=num)
dispatch_117 = Dispatch(List=pt_3, DispatchPattern=node_10)  # -> ListA, ListB
expression_120 = Expression(x=expression_5, c=expression_118, t=frame_section, Expression="min(x-t/2,c-45)")
expression_121 = Expression(x=expression_5, c=expression_118, t=frame_section, Expression="max(x+t/2,c+45)")
dom_41 = ConstructDomain(DomainStart=expression_120, DomainEnd=expression_121)
expression_122 = Expression(y=expression, c=expression_119, t=frame_section, Expression="min(y-t/2,c-40)")
expression_123 = Expression(y=expression, c=expression_119, t=frame_section, Expression="max(y+t/2,c+40)")
dom_42 = ConstructDomain(DomainStart=expression_122, DomainEnd=expression_123)
dom_43 = ConstructDomain(DomainStart=num_18, DomainEnd=num_6)
box_115 = DomainBox(Base=PlaneXY(0, 0, 0), X=dom_41, Y=dom_42, Z=dom_43)
dispatch_118 = Dispatch(List=box_115, DispatchPattern=node_10)  # -> ListA, ListB
expression_124 = Expression(a=m21_active, Expression="if(a>0,1,0)")
expression_125 = Expression(a=m31_active, Expression="if(a>0,1,0)")
expression_126 = Expression(a=m21_active, b=m31_active, Expression="if(a+b>0,1,0)")
expression_127 = Expression(x=expression_6, r=expression_125, l=expression_124, Expression="x+100*(r-l)")
expression_128 = Expression(y=expression, r=expression_126, l=num, Expression="y+100*(r-l)")
pt_4 = ConstructPoint(XCoordinate=expression_127, YCoordinate=expression_128, ZCoordinate=num)
dispatch_119 = Dispatch(List=pt_4, DispatchPattern=node_20)  # -> ListA, ListB
expression_129 = Expression(x=expression_6, c=expression_127, t=frame_section, Expression="min(x-t/2,c-45)")
expression_130 = Expression(x=expression_6, c=expression_127, t=frame_section, Expression="max(x+t/2,c+45)")
dom_44 = ConstructDomain(DomainStart=expression_129, DomainEnd=expression_130)
expression_131 = Expression(y=expression, c=expression_128, t=frame_section, Expression="min(y-t/2,c-40)")
expression_132 = Expression(y=expression, c=expression_128, t=frame_section, Expression="max(y+t/2,c+40)")
dom_45 = ConstructDomain(DomainStart=expression_131, DomainEnd=expression_132)
dom_46 = ConstructDomain(DomainStart=num_18, DomainEnd=num_6)
box_116 = DomainBox(Base=PlaneXY(0, 0, 0), X=dom_44, Y=dom_45, Z=dom_46)
dispatch_120 = Dispatch(List=box_116, DispatchPattern=node_20)  # -> ListA, ListB
expression_133 = Expression(a=m31_active, Expression="if(a>0,1,0)")
expression_134 = Expression(a=m31_active, Expression="if(a>0,1,0)")
expression_135 = Expression(x=expression_7, r=num, l=expression_133, Expression="x+100*(r-l)")
expression_136 = Expression(y=expression, r=expression_134, l=num, Expression="y+100*(r-l)")
pt_5 = ConstructPoint(XCoordinate=expression_135, YCoordinate=expression_136, ZCoordinate=num)
dispatch_121 = Dispatch(List=pt_5, DispatchPattern=node_30)  # -> ListA, ListB
expression_137 = Expression(x=expression_7, c=expression_135, t=frame_section, Expression="min(x-t/2,c-45)")
expression_138 = Expression(x=expression_7, c=expression_135, t=frame_section, Expression="max(x+t/2,c+45)")
dom_47 = ConstructDomain(DomainStart=expression_137, DomainEnd=expression_138)
expression_139 = Expression(y=expression, c=expression_136, t=frame_section, Expression="min(y-t/2,c-40)")
expression_140 = Expression(y=expression, c=expression_136, t=frame_section, Expression="max(y+t/2,c+40)")
dom_48 = ConstructDomain(DomainStart=expression_139, DomainEnd=expression_140)
dom_49 = ConstructDomain(DomainStart=num_18, DomainEnd=num_6)
box_117 = DomainBox(Base=PlaneXY(0, 0, 0), X=dom_47, Y=dom_48, Z=dom_49)
dispatch_122 = Dispatch(List=box_117, DispatchPattern=node_30)  # -> ListA, ListB
expression_141 = Expression(a=m11_active, b=m12_active, Expression="if(a+b>0,1,0)")
expression_142 = Expression(a=m11_active, Expression="if(a>0,1,0)")
expression_143 = Expression(a=m12_active, Expression="if(a>0,1,0)")
expression_144 = Expression(x=expression, r=expression_141, l=num, Expression="x+100*(r-l)")
expression_145 = Expression(y=expression_10, r=expression_143, l=expression_142, Expression="y+100*(r-l)")
pt_6 = ConstructPoint(XCoordinate=expression_144, YCoordinate=expression_145, ZCoordinate=num)
dispatch_123 = Dispatch(List=pt_6, DispatchPattern=node_01)  # -> ListA, ListB
expression_146 = Expression(x=expression, c=expression_144, t=frame_section, Expression="min(x-t/2,c-45)")
expression_147 = Expression(x=expression, c=expression_144, t=frame_section, Expression="max(x+t/2,c+45)")
dom_50 = ConstructDomain(DomainStart=expression_146, DomainEnd=expression_147)
expression_148 = Expression(y=expression_10, c=expression_145, t=frame_section, Expression="min(y-t/2,c-40)")
expression_149 = Expression(y=expression_10, c=expression_145, t=frame_section, Expression="max(y+t/2,c+40)")
dom_51 = ConstructDomain(DomainStart=expression_148, DomainEnd=expression_149)
dom_52 = ConstructDomain(DomainStart=num_18, DomainEnd=num_6)
box_118 = DomainBox(Base=PlaneXY(0, 0, 0), X=dom_50, Y=dom_51, Z=dom_52)
dispatch_124 = Dispatch(List=box_118, DispatchPattern=node_01)  # -> ListA, ListB
expression_150 = Expression(a=m11_active, b=m12_active, Expression="if(a+b>0,1,0)")
expression_151 = Expression(a=m21_active, b=m22_active, Expression="if(a+b>0,1,0)")
expression_152 = Expression(a=m11_active, b=m21_active, Expression="if(a+b>0,1,0)")
expression_153 = Expression(a=m12_active, b=m22_active, Expression="if(a+b>0,1,0)")
expression_154 = Expression(x=expression_5, r=expression_151, l=expression_150, Expression="x+100*(r-l)")
expression_155 = Expression(y=expression_10, r=expression_153, l=expression_152, Expression="y+100*(r-l)")
pt_7 = ConstructPoint(XCoordinate=expression_154, YCoordinate=expression_155, ZCoordinate=num)
dispatch_125 = Dispatch(List=pt_7, DispatchPattern=node_11)  # -> ListA, ListB
expression_156 = Expression(x=expression_5, c=expression_154, t=frame_section, Expression="min(x-t/2,c-45)")
expression_157 = Expression(x=expression_5, c=expression_154, t=frame_section, Expression="max(x+t/2,c+45)")
dom_53 = ConstructDomain(DomainStart=expression_156, DomainEnd=expression_157)
expression_158 = Expression(y=expression_10, c=expression_155, t=frame_section, Expression="min(y-t/2,c-40)")
expression_159 = Expression(y=expression_10, c=expression_155, t=frame_section, Expression="max(y+t/2,c+40)")
dom_54 = ConstructDomain(DomainStart=expression_158, DomainEnd=expression_159)
dom_55 = ConstructDomain(DomainStart=num_18, DomainEnd=num_6)
box_119 = DomainBox(Base=PlaneXY(0, 0, 0), X=dom_53, Y=dom_54, Z=dom_55)
dispatch_126 = Dispatch(List=box_119, DispatchPattern=node_11)  # -> ListA, ListB
expression_160 = Expression(a=m21_active, b=m22_active, Expression="if(a+b>0,1,0)")
expression_161 = Expression(a=m31_active, b=m32_active, Expression="if(a+b>0,1,0)")
expression_162 = Expression(a=m21_active, b=m31_active, Expression="if(a+b>0,1,0)")
expression_163 = Expression(a=m22_active, b=m32_active, Expression="if(a+b>0,1,0)")
expression_164 = Expression(x=expression_6, r=expression_161, l=expression_160, Expression="x+100*(r-l)")
expression_165 = Expression(y=expression_10, r=expression_163, l=expression_162, Expression="y+100*(r-l)")
pt_8 = ConstructPoint(XCoordinate=expression_164, YCoordinate=expression_165, ZCoordinate=num)
dispatch_127 = Dispatch(List=pt_8, DispatchPattern=node_21)  # -> ListA, ListB
expression_166 = Expression(x=expression_6, c=expression_164, t=frame_section, Expression="min(x-t/2,c-45)")
expression_167 = Expression(x=expression_6, c=expression_164, t=frame_section, Expression="max(x+t/2,c+45)")
dom_56 = ConstructDomain(DomainStart=expression_166, DomainEnd=expression_167)
expression_168 = Expression(y=expression_10, c=expression_165, t=frame_section, Expression="min(y-t/2,c-40)")
expression_169 = Expression(y=expression_10, c=expression_165, t=frame_section, Expression="max(y+t/2,c+40)")
dom_57 = ConstructDomain(DomainStart=expression_168, DomainEnd=expression_169)
dom_58 = ConstructDomain(DomainStart=num_18, DomainEnd=num_6)
box_120 = DomainBox(Base=PlaneXY(0, 0, 0), X=dom_56, Y=dom_57, Z=dom_58)
dispatch_128 = Dispatch(List=box_120, DispatchPattern=node_21)  # -> ListA, ListB
expression_170 = Expression(a=m31_active, b=m32_active, Expression="if(a+b>0,1,0)")
expression_171 = Expression(a=m31_active, Expression="if(a>0,1,0)")
expression_172 = Expression(a=m32_active, Expression="if(a>0,1,0)")
expression_173 = Expression(x=expression_7, r=num, l=expression_170, Expression="x+100*(r-l)")
expression_174 = Expression(y=expression_10, r=expression_172, l=expression_171, Expression="y+100*(r-l)")
pt_9 = ConstructPoint(XCoordinate=expression_173, YCoordinate=expression_174, ZCoordinate=num)
dispatch_129 = Dispatch(List=pt_9, DispatchPattern=node_31)  # -> ListA, ListB
expression_175 = Expression(x=expression_7, c=expression_173, t=frame_section, Expression="min(x-t/2,c-45)")
expression_176 = Expression(x=expression_7, c=expression_173, t=frame_section, Expression="max(x+t/2,c+45)")
dom_59 = ConstructDomain(DomainStart=expression_175, DomainEnd=expression_176)
expression_177 = Expression(y=expression_10, c=expression_174, t=frame_section, Expression="min(y-t/2,c-40)")
expression_178 = Expression(y=expression_10, c=expression_174, t=frame_section, Expression="max(y+t/2,c+40)")
dom_60 = ConstructDomain(DomainStart=expression_177, DomainEnd=expression_178)
dom_61 = ConstructDomain(DomainStart=num_18, DomainEnd=num_6)
box_121 = DomainBox(Base=PlaneXY(0, 0, 0), X=dom_59, Y=dom_60, Z=dom_61)
dispatch_130 = Dispatch(List=box_121, DispatchPattern=node_31)  # -> ListA, ListB
expression_179 = Expression(a=m12_active, b=m13_active, Expression="if(a+b>0,1,0)")
expression_180 = Expression(a=m12_active, Expression="if(a>0,1,0)")
expression_181 = Expression(a=m13_active, Expression="if(a>0,1,0)")
expression_182 = Expression(x=expression, r=expression_179, l=num, Expression="x+100*(r-l)")
expression_183 = Expression(y=expression_11, r=expression_181, l=expression_180, Expression="y+100*(r-l)")
pt_10 = ConstructPoint(XCoordinate=expression_182, YCoordinate=expression_183, ZCoordinate=num)
dispatch_131 = Dispatch(List=pt_10, DispatchPattern=node_02)  # -> ListA, ListB
expression_184 = Expression(x=expression, c=expression_182, t=frame_section, Expression="min(x-t/2,c-45)")
expression_185 = Expression(x=expression, c=expression_182, t=frame_section, Expression="max(x+t/2,c+45)")
dom_62 = ConstructDomain(DomainStart=expression_184, DomainEnd=expression_185)
expression_186 = Expression(y=expression_11, c=expression_183, t=frame_section, Expression="min(y-t/2,c-40)")
expression_187 = Expression(y=expression_11, c=expression_183, t=frame_section, Expression="max(y+t/2,c+40)")
dom_63 = ConstructDomain(DomainStart=expression_186, DomainEnd=expression_187)
dom_64 = ConstructDomain(DomainStart=num_18, DomainEnd=num_6)
box_122 = DomainBox(Base=PlaneXY(0, 0, 0), X=dom_62, Y=dom_63, Z=dom_64)
dispatch_132 = Dispatch(List=box_122, DispatchPattern=node_02)  # -> ListA, ListB
expression_188 = Expression(a=m12_active, b=m13_active, Expression="if(a+b>0,1,0)")
expression_189 = Expression(a=m22_active, b=m23_active, Expression="if(a+b>0,1,0)")
expression_190 = Expression(a=m12_active, b=m22_active, Expression="if(a+b>0,1,0)")
expression_191 = Expression(a=m13_active, b=m23_active, Expression="if(a+b>0,1,0)")
expression_192 = Expression(x=expression_5, r=expression_189, l=expression_188, Expression="x+100*(r-l)")
expression_193 = Expression(y=expression_11, r=expression_191, l=expression_190, Expression="y+100*(r-l)")
pt_11 = ConstructPoint(XCoordinate=expression_192, YCoordinate=expression_193, ZCoordinate=num)
dispatch_133 = Dispatch(List=pt_11, DispatchPattern=node_12)  # -> ListA, ListB
expression_194 = Expression(x=expression_5, c=expression_192, t=frame_section, Expression="min(x-t/2,c-45)")
expression_195 = Expression(x=expression_5, c=expression_192, t=frame_section, Expression="max(x+t/2,c+45)")
dom_65 = ConstructDomain(DomainStart=expression_194, DomainEnd=expression_195)
expression_196 = Expression(y=expression_11, c=expression_193, t=frame_section, Expression="min(y-t/2,c-40)")
expression_197 = Expression(y=expression_11, c=expression_193, t=frame_section, Expression="max(y+t/2,c+40)")
dom_66 = ConstructDomain(DomainStart=expression_196, DomainEnd=expression_197)
dom_67 = ConstructDomain(DomainStart=num_18, DomainEnd=num_6)
box_123 = DomainBox(Base=PlaneXY(0, 0, 0), X=dom_65, Y=dom_66, Z=dom_67)
dispatch_134 = Dispatch(List=box_123, DispatchPattern=node_12)  # -> ListA, ListB
expression_198 = Expression(a=m22_active, b=m23_active, Expression="if(a+b>0,1,0)")
expression_199 = Expression(a=m32_active, b=m33_active, Expression="if(a+b>0,1,0)")
expression_200 = Expression(a=m22_active, b=m32_active, Expression="if(a+b>0,1,0)")
expression_201 = Expression(a=m23_active, b=m33_active, Expression="if(a+b>0,1,0)")
expression_202 = Expression(x=expression_6, r=expression_199, l=expression_198, Expression="x+100*(r-l)")
expression_203 = Expression(y=expression_11, r=expression_201, l=expression_200, Expression="y+100*(r-l)")
pt_12 = ConstructPoint(XCoordinate=expression_202, YCoordinate=expression_203, ZCoordinate=num)
dispatch_135 = Dispatch(List=pt_12, DispatchPattern=node_22)  # -> ListA, ListB
expression_204 = Expression(x=expression_6, c=expression_202, t=frame_section, Expression="min(x-t/2,c-45)")
expression_205 = Expression(x=expression_6, c=expression_202, t=frame_section, Expression="max(x+t/2,c+45)")
dom_68 = ConstructDomain(DomainStart=expression_204, DomainEnd=expression_205)
expression_206 = Expression(y=expression_11, c=expression_203, t=frame_section, Expression="min(y-t/2,c-40)")
expression_207 = Expression(y=expression_11, c=expression_203, t=frame_section, Expression="max(y+t/2,c+40)")
dom_69 = ConstructDomain(DomainStart=expression_206, DomainEnd=expression_207)
dom_70 = ConstructDomain(DomainStart=num_18, DomainEnd=num_6)
box_124 = DomainBox(Base=PlaneXY(0, 0, 0), X=dom_68, Y=dom_69, Z=dom_70)
dispatch_136 = Dispatch(List=box_124, DispatchPattern=node_22)  # -> ListA, ListB
expression_208 = Expression(a=m32_active, b=m33_active, Expression="if(a+b>0,1,0)")
expression_209 = Expression(a=m32_active, Expression="if(a>0,1,0)")
expression_210 = Expression(a=m33_active, Expression="if(a>0,1,0)")
expression_211 = Expression(x=expression_7, r=num, l=expression_208, Expression="x+100*(r-l)")
expression_212 = Expression(y=expression_11, r=expression_210, l=expression_209, Expression="y+100*(r-l)")
pt_13 = ConstructPoint(XCoordinate=expression_211, YCoordinate=expression_212, ZCoordinate=num)
dispatch_137 = Dispatch(List=pt_13, DispatchPattern=node_32)  # -> ListA, ListB
expression_213 = Expression(x=expression_7, c=expression_211, t=frame_section, Expression="min(x-t/2,c-45)")
expression_214 = Expression(x=expression_7, c=expression_211, t=frame_section, Expression="max(x+t/2,c+45)")
dom_71 = ConstructDomain(DomainStart=expression_213, DomainEnd=expression_214)
expression_215 = Expression(y=expression_11, c=expression_212, t=frame_section, Expression="min(y-t/2,c-40)")
expression_216 = Expression(y=expression_11, c=expression_212, t=frame_section, Expression="max(y+t/2,c+40)")
dom_72 = ConstructDomain(DomainStart=expression_215, DomainEnd=expression_216)
dom_73 = ConstructDomain(DomainStart=num_18, DomainEnd=num_6)
box_125 = DomainBox(Base=PlaneXY(0, 0, 0), X=dom_71, Y=dom_72, Z=dom_73)
dispatch_138 = Dispatch(List=box_125, DispatchPattern=node_32)  # -> ListA, ListB
expression_217 = Expression(a=m13_active, Expression="if(a>0,1,0)")
expression_218 = Expression(a=m13_active, Expression="if(a>0,1,0)")
expression_219 = Expression(x=expression, r=expression_217, l=num, Expression="x+100*(r-l)")
expression_220 = Expression(y=expression_12, r=num, l=expression_218, Expression="y+100*(r-l)")
pt_14 = ConstructPoint(XCoordinate=expression_219, YCoordinate=expression_220, ZCoordinate=num)
dispatch_139 = Dispatch(List=pt_14, DispatchPattern=node_03)  # -> ListA, ListB
expression_221 = Expression(x=expression, c=expression_219, t=frame_section, Expression="min(x-t/2,c-45)")
expression_222 = Expression(x=expression, c=expression_219, t=frame_section, Expression="max(x+t/2,c+45)")
dom_74 = ConstructDomain(DomainStart=expression_221, DomainEnd=expression_222)
expression_223 = Expression(y=expression_12, c=expression_220, t=frame_section, Expression="min(y-t/2,c-40)")
expression_224 = Expression(y=expression_12, c=expression_220, t=frame_section, Expression="max(y+t/2,c+40)")
dom_75 = ConstructDomain(DomainStart=expression_223, DomainEnd=expression_224)
dom_76 = ConstructDomain(DomainStart=num_18, DomainEnd=num_6)
box_126 = DomainBox(Base=PlaneXY(0, 0, 0), X=dom_74, Y=dom_75, Z=dom_76)
dispatch_140 = Dispatch(List=box_126, DispatchPattern=node_03)  # -> ListA, ListB
expression_225 = Expression(a=m13_active, Expression="if(a>0,1,0)")
expression_226 = Expression(a=m23_active, Expression="if(a>0,1,0)")
expression_227 = Expression(a=m13_active, b=m23_active, Expression="if(a+b>0,1,0)")
expression_228 = Expression(x=expression_5, r=expression_226, l=expression_225, Expression="x+100*(r-l)")
expression_229 = Expression(y=expression_12, r=num, l=expression_227, Expression="y+100*(r-l)")
pt_15 = ConstructPoint(XCoordinate=expression_228, YCoordinate=expression_229, ZCoordinate=num)
dispatch_141 = Dispatch(List=pt_15, DispatchPattern=node_13)  # -> ListA, ListB
expression_230 = Expression(x=expression_5, c=expression_228, t=frame_section, Expression="min(x-t/2,c-45)")
expression_231 = Expression(x=expression_5, c=expression_228, t=frame_section, Expression="max(x+t/2,c+45)")
dom_77 = ConstructDomain(DomainStart=expression_230, DomainEnd=expression_231)
expression_232 = Expression(y=expression_12, c=expression_229, t=frame_section, Expression="min(y-t/2,c-40)")
expression_233 = Expression(y=expression_12, c=expression_229, t=frame_section, Expression="max(y+t/2,c+40)")
dom_78 = ConstructDomain(DomainStart=expression_232, DomainEnd=expression_233)
dom_79 = ConstructDomain(DomainStart=num_18, DomainEnd=num_6)
box_127 = DomainBox(Base=PlaneXY(0, 0, 0), X=dom_77, Y=dom_78, Z=dom_79)
dispatch_142 = Dispatch(List=box_127, DispatchPattern=node_13)  # -> ListA, ListB
expression_234 = Expression(a=m23_active, Expression="if(a>0,1,0)")
expression_235 = Expression(a=m33_active, Expression="if(a>0,1,0)")
expression_236 = Expression(a=m23_active, b=m33_active, Expression="if(a+b>0,1,0)")
expression_237 = Expression(x=expression_6, r=expression_235, l=expression_234, Expression="x+100*(r-l)")
expression_238 = Expression(y=expression_12, r=num, l=expression_236, Expression="y+100*(r-l)")
pt_16 = ConstructPoint(XCoordinate=expression_237, YCoordinate=expression_238, ZCoordinate=num)
dispatch_143 = Dispatch(List=pt_16, DispatchPattern=node_23)  # -> ListA, ListB
expression_239 = Expression(x=expression_6, c=expression_237, t=frame_section, Expression="min(x-t/2,c-45)")
expression_240 = Expression(x=expression_6, c=expression_237, t=frame_section, Expression="max(x+t/2,c+45)")
dom_80 = ConstructDomain(DomainStart=expression_239, DomainEnd=expression_240)
expression_241 = Expression(y=expression_12, c=expression_238, t=frame_section, Expression="min(y-t/2,c-40)")
expression_242 = Expression(y=expression_12, c=expression_238, t=frame_section, Expression="max(y+t/2,c+40)")
dom_81 = ConstructDomain(DomainStart=expression_241, DomainEnd=expression_242)
dom_82 = ConstructDomain(DomainStart=num_18, DomainEnd=num_6)
box_128 = DomainBox(Base=PlaneXY(0, 0, 0), X=dom_80, Y=dom_81, Z=dom_82)
dispatch_144 = Dispatch(List=box_128, DispatchPattern=node_23)  # -> ListA, ListB
expression_243 = Expression(a=m33_active, Expression="if(a>0,1,0)")
expression_244 = Expression(a=m33_active, Expression="if(a>0,1,0)")
expression_245 = Expression(x=expression_7, r=num, l=expression_243, Expression="x+100*(r-l)")
expression_246 = Expression(y=expression_12, r=num, l=expression_244, Expression="y+100*(r-l)")
pt_17 = ConstructPoint(XCoordinate=expression_245, YCoordinate=expression_246, ZCoordinate=num)
dispatch_145 = Dispatch(List=pt_17, DispatchPattern=node_33)  # -> ListA, ListB
expression_247 = Expression(x=expression_7, c=expression_245, t=frame_section, Expression="min(x-t/2,c-45)")
expression_248 = Expression(x=expression_7, c=expression_245, t=frame_section, Expression="max(x+t/2,c+45)")
dom_83 = ConstructDomain(DomainStart=expression_247, DomainEnd=expression_248)
expression_249 = Expression(y=expression_12, c=expression_246, t=frame_section, Expression="min(y-t/2,c-40)")
expression_250 = Expression(y=expression_12, c=expression_246, t=frame_section, Expression="max(y+t/2,c+40)")
dom_84 = ConstructDomain(DomainStart=expression_249, DomainEnd=expression_250)
dom_85 = ConstructDomain(DomainStart=num_18, DomainEnd=num_6)
box_129 = DomainBox(Base=PlaneXY(0, 0, 0), X=dom_83, Y=dom_84, Z=dom_85)
dispatch_146 = Dispatch(List=box_129, DispatchPattern=node_33)  # -> ListA, ListB

# ---- group: 08 Front signs - editable text
num_19 = Number(15)
num_20 = Number(-330)
num_21 = Number(-185)
num_22 = Number(7.7)
col = Colour(RGB(255, 255, 255))
num_23 = Number(4)
num_24 = Number(2.8)
col_2 = Colour(RGB(255, 255, 255))
expression_251 = Expression(a=frame_section, b=num_16, Expression="a+b")
expression_252 = Expression(a=frame_section, b=num_19, Expression="a+b")
dom_86 = ConstructDomain(DomainStart=expression_251, DomainEnd=expression_252)
expression_253 = Expression(a=overall_height, b=num_20, Expression="a+b")
expression_254 = Expression(h=overall_height, t=frame_section, Expression="h-t-3")
dom_87 = ConstructDomain(DomainStart=expression_253, DomainEnd=expression_254)
box_130 = DomainBox(Base=PlaneXY(0, 0, 0), X=dom_32, Y=dom_86, Z=dom_87)
dispatch_147 = Dispatch(List=box_130, DispatchPattern=m11_active)  # -> ListA, ListB
expression_255 = Expression(a=expression, b=expression_5, Expression="(a+b)/2")
expression_256 = Expression(a=frame_section, b=num_5, Expression="a+b")
expression_257 = Expression(a=overall_height, b=num_21, Expression="a+b")
pt_18 = ConstructPoint(XCoordinate=expression_255, YCoordinate=expression_256, ZCoordinate=expression_257)
pt_19 = ConstructPoint(XCoordinate=num_2, YCoordinate=num, ZCoordinate=num)
pt_20 = ConstructPoint(XCoordinate=num, YCoordinate=num, ZCoordinate=num_2)
pl = ConstructPlane(Origin=pt_18, XAxis=pt_19, YAxis=pt_20)
dispatch_148 = Dispatch(List=pl, DispatchPattern=m11_active)  # -> ListA, ListB
sign_1_text = Panel("INFORMATION")
expression_258 = Expression(a=expression, b=expression_5, n=num_22, Expression="min(90,(b-a-80)/n)")
sign_1_bake_text_here = TextTag3D(Location=dispatch_148.ListA, Text=sign_1_text, Size=expression_258, Colour=col, Justification=num_23)
expression_259 = Expression(a=frame_section, b=num_16, Expression="a+b")
expression_260 = Expression(a=frame_section, b=num_19, Expression="a+b")
dom_88 = ConstructDomain(DomainStart=expression_259, DomainEnd=expression_260)
expression_261 = Expression(a=overall_height, b=num_20, Expression="a+b")
expression_262 = Expression(h=overall_height, t=frame_section, Expression="h-t-3")
dom_89 = ConstructDomain(DomainStart=expression_261, DomainEnd=expression_262)
box_131 = DomainBox(Base=PlaneXY(0, 0, 0), X=dom_34, Y=dom_88, Z=dom_89)
dispatch_149 = Dispatch(List=box_131, DispatchPattern=m21_active)  # -> ListA, ListB
expression_263 = Expression(a=expression_5, b=expression_6, Expression="(a+b)/2")
expression_264 = Expression(a=frame_section, b=num_5, Expression="a+b")
expression_265 = Expression(a=overall_height, b=num_21, Expression="a+b")
pt_21 = ConstructPoint(XCoordinate=expression_263, YCoordinate=expression_264, ZCoordinate=expression_265)
pt_22 = ConstructPoint(XCoordinate=num_2, YCoordinate=num, ZCoordinate=num)
pt_23 = ConstructPoint(XCoordinate=num, YCoordinate=num, ZCoordinate=num_2)
pl_2 = ConstructPlane(Origin=pt_21, XAxis=pt_22, YAxis=pt_23)
dispatch_150 = Dispatch(List=pl_2, DispatchPattern=m21_active)  # -> ListA, ListB
sign_2_text = Panel("DESK")
expression_266 = Expression(a=expression_5, b=expression_6, n=num_24, Expression="min(90,(b-a-80)/n)")
sign_2_bake_text_here = TextTag3D(Location=dispatch_150.ListA, Text=sign_2_text, Size=expression_266, Colour=col_2, Justification=num_23)
expression_267 = Expression(a=frame_section, b=num_16, Expression="a+b")
expression_268 = Expression(a=frame_section, b=num_19, Expression="a+b")
dom_90 = ConstructDomain(DomainStart=expression_267, DomainEnd=expression_268)
expression_269 = Expression(a=overall_height, b=num_20, Expression="a+b")
expression_270 = Expression(h=overall_height, t=frame_section, Expression="h-t-3")
dom_91 = ConstructDomain(DomainStart=expression_269, DomainEnd=expression_270)
box_132 = DomainBox(Base=PlaneXY(0, 0, 0), X=dom_36, Y=dom_90, Z=dom_91)
dispatch_151 = Dispatch(List=box_132, DispatchPattern=m31_active)  # -> ListA, ListB
expression_271 = Expression(a=expression_6, b=expression_7, Expression="(a+b)/2")
expression_272 = Expression(a=frame_section, b=num_5, Expression="a+b")
expression_273 = Expression(a=overall_height, b=num_21, Expression="a+b")
pt_24 = ConstructPoint(XCoordinate=expression_271, YCoordinate=expression_272, ZCoordinate=expression_273)
pt_25 = ConstructPoint(XCoordinate=num_2, YCoordinate=num, ZCoordinate=num)
pt_26 = ConstructPoint(XCoordinate=num, YCoordinate=num, ZCoordinate=num_2)
pl_3 = ConstructPlane(Origin=pt_24, XAxis=pt_25, YAxis=pt_26)

# ---- group: 08 Vendor caster geometry - no substitute wheels
manner_301799_cad = Geometry(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)
caster_positions = Merge(Data1=[dispatch_115.ListA, dispatch_117.ListA, dispatch_119.ListA, dispatch_121.ListA, dispatch_123.ListA, dispatch_125.ListA, dispatch_127.ListA, dispatch_129.ListA, dispatch_131.ListA, dispatch_133.ListA, dispatch_135.ListA, dispatch_137.ListA, dispatch_139.ListA, dispatch_141.ListA, dispatch_143.ListA, dispatch_145.ListA])
place_vendor_casters = Move(Geometry=manner_301799_cad, Motion=caster_positions)  # -> Geometry, Transform

# ---- group: 07 M21 panels and shelves
expression_274 = Expression(x=expression_5, t=frame_section, Expression="x+t/2+3")
expression_275 = Expression(x=expression_6, t=frame_section, Expression="x-t/2-3")
expression_276 = Expression(y=expression, t=frame_section, Expression="y+t/2+3")
expression_277 = Expression(y=expression_10, t=frame_section, Expression="y-t/2-3")
dom_92 = ConstructDomain(DomainStart=expression_274, DomainEnd=expression_275)
dom_93 = ConstructDomain(DomainStart=expression_276, DomainEnd=expression_277)
box_133 = DomainBox(Base=PlaneXY(0, 0, 0), X=dom_92, Y=dom_93, Z=dom_6)
dispatch_152 = Dispatch(List=box_133, DispatchPattern=m21_active)  # -> ListA, ListB
box_134 = DomainBox(Base=PlaneXY(0, 0, 0), X=dom_92, Y=dom_93, Z=dom_7)
dispatch_153 = Dispatch(List=box_134, DispatchPattern=m21_active)  # -> ListA, ListB
expression_278 = Expression(a=frame_section, b=num_8, Expression="a+b")
expression_279 = Expression(a=counter_height, b=num_9, Expression="a+b")
dom_94 = ConstructDomain(DomainStart=expression_278, DomainEnd=expression_279)
expression_280 = Expression(a=expression_274, b=num_10, Expression="a+b")
dom_95 = ConstructDomain(DomainStart=expression_274, DomainEnd=expression_280)
box_135 = DomainBox(Base=PlaneXY(0, 0, 0), X=dom_95, Y=dom_93, Z=dom_94)
dispatch_154 = Dispatch(List=box_135, DispatchPattern=m21_active)  # -> ListA, ListB
expression_281 = Expression(a=expression_275, b=num_11, Expression="a+b")
dom_96 = ConstructDomain(DomainStart=expression_281, DomainEnd=expression_275)
box_136 = DomainBox(Base=PlaneXY(0, 0, 0), X=dom_96, Y=dom_93, Z=dom_94)
dispatch_155 = Dispatch(List=box_136, DispatchPattern=m21_active)  # -> ListA, ListB
expression_282 = Expression(a=expression_274, b=num_10, Expression="a+b")
expression_283 = Expression(a=expression_275, b=num_11, Expression="a+b")
dom_97 = ConstructDomain(DomainStart=expression_282, DomainEnd=expression_283)
expression_284 = Expression(a=m21_active, k=m21_type, Expression="a*if(k<1.5,1,if(k>2.5,1,0))")
expression_285 = Expression(a=expression_276, b=num_10, Expression="a+b")
dom_98 = ConstructDomain(DomainStart=expression_276, DomainEnd=expression_285)
box_137 = DomainBox(Base=PlaneXY(0, 0, 0), X=dom_97, Y=dom_98, Z=dom_94)
dispatch_156 = Dispatch(List=box_137, DispatchPattern=expression_284)  # -> ListA, ListB
expression_286 = Expression(a=expression_274, b=expression_275, Expression="(a+b)/2")
expression_287 = Expression(a=expression_274, b=num_10, Expression="a+b")
expression_288 = Expression(a=expression_286, b=num_12, Expression="a+b")
dom_99 = ConstructDomain(DomainStart=expression_287, DomainEnd=expression_288)
expression_289 = Expression(a=expression_277, b=num_11, Expression="a+b")
dom_100 = ConstructDomain(DomainStart=expression_289, DomainEnd=expression_277)
box_138 = DomainBox(Base=PlaneXY(0, 0, 0), X=dom_99, Y=dom_100, Z=dom_94)
dispatch_157 = Dispatch(List=box_138, DispatchPattern=m21_active)  # -> ListA, ListB
expression_290 = Expression(a=expression_286, b=num_13, Expression="a+b")
expression_291 = Expression(a=expression_275, b=num_11, Expression="a+b")
dom_101 = ConstructDomain(DomainStart=expression_290, DomainEnd=expression_291)
expression_292 = Expression(a=expression_277, b=num_11, Expression="a+b")
dom_102 = ConstructDomain(DomainStart=expression_292, DomainEnd=expression_277)
box_139 = DomainBox(Base=PlaneXY(0, 0, 0), X=dom_101, Y=dom_102, Z=dom_94)
dispatch_158 = Dispatch(List=box_139, DispatchPattern=m21_active)  # -> ListA, ListB
expression_293 = Expression(a=m21_active, k=m21_type, Expression="a*if(k>2.5,1,0)")
expression_294 = Expression(a=m21_active, k=m21_type, n=m21_shelf_count, Expression="a*if(k>1.5,if(n>0,1,0),0)")
expression_295 = Expression(k=m21_type, c=counter_height, b=num_6, t=frame_section, Expression="if(k>2.5,c+100,b+t+60)")
expression_296 = Expression(k=m21_type, h=overall_height, c=counter_height, Expression="if(k>2.5,h-400,c-50)")
expression_297 = Expression(
    lo=expression_295,
    hi=expression_296,
    n=m21_shelf_count,
    a=m21_first_shelf,
    b=m21_last_shelf,
    Expression="max(lo,min(hi-40*max(n-1,0),min(a,b)))")
expression_298 = Expression(
    lo=expression_297,
    hi=expression_296,
    n=m21_shelf_count,
    a=m21_first_shelf,
    b=m21_last_shelf,
    Expression="max(lo+40*max(n-1,0),min(hi,max(a,b)))")
expression_299 = Expression(n=m21_shelf_count, Expression="max(1,n)")
series_2 = Series(Start=num, Step=num_2, Count=expression_299)
m21_shelf_levels = Expression(n=m21_shelf_count, a=expression_297, b=expression_298, i=series_2, Expression="if(n<1.5,a,a+(b-a)*i/max(1,n-1))")
expression_300 = Expression(a=expression_276, b=expression_277, d=shelf_depth, Expression="max(a+21,b-d-21)")
expression_301 = Expression(a=expression_274, b=num_10, Expression="a+b")
expression_302 = Expression(a=expression_275, b=num_11, Expression="a+b")
dom_103 = ConstructDomain(DomainStart=expression_301, DomainEnd=expression_302)
expression_303 = Expression(a=expression_277, b=num_14, Expression="a+b")
dom_104 = ConstructDomain(DomainStart=expression_300, DomainEnd=expression_303)
expression_304 = Expression(a=m21_shelf_levels, b=num_11, Expression="a+b")
dom_105 = ConstructDomain(DomainStart=expression_304, DomainEnd=m21_shelf_levels)
box_140 = DomainBox(Base=PlaneXY(0, 0, 0), X=dom_103, Y=dom_104, Z=dom_105)
dispatch_159 = Dispatch(List=box_140, DispatchPattern=expression_294)  # -> ListA, ListB
expression_305 = Expression(a=expression_277, b=num_15, Expression="a+b")
dom_106 = ConstructDomain(DomainStart=expression_305, DomainEnd=expression_277)
expression_306 = Expression(a=counter_height, b=num_16, Expression="a+b")
expression_307 = Expression(a=expression_298, b=num_17, Expression="a+b")
dom_107 = ConstructDomain(DomainStart=expression_306, DomainEnd=expression_307)
box_141 = DomainBox(Base=PlaneXY(0, 0, 0), X=dom_92, Y=dom_106, Z=dom_107)
dispatch_160 = Dispatch(List=box_141, DispatchPattern=expression_293)  # -> ListA, ListB
expression_308 = Expression(a=expression_5, b=expression_6, Expression="b-a")
expression_309 = Expression(a=expression, b=expression_10, Expression="b-a")
pt_27 = ConstructPoint(XCoordinate=expression_308, YCoordinate=expression_309, ZCoordinate=counter_height)
dispatch_161 = Dispatch(List=pt_27, DispatchPattern=m21_active)  # -> ListA, ListB

# ---- group: 07 M31 panels and shelves
expression_310 = Expression(x=expression_6, t=frame_section, Expression="x+t/2+3")
expression_311 = Expression(x=expression_7, t=frame_section, Expression="x-t/2-3")
expression_312 = Expression(y=expression, t=frame_section, Expression="y+t/2+3")
expression_313 = Expression(y=expression_10, t=frame_section, Expression="y-t/2-3")
dom_108 = ConstructDomain(DomainStart=expression_310, DomainEnd=expression_311)
dom_109 = ConstructDomain(DomainStart=expression_312, DomainEnd=expression_313)
box_142 = DomainBox(Base=PlaneXY(0, 0, 0), X=dom_108, Y=dom_109, Z=dom_6)
dispatch_162 = Dispatch(List=box_142, DispatchPattern=m31_active)  # -> ListA, ListB
box_143 = DomainBox(Base=PlaneXY(0, 0, 0), X=dom_108, Y=dom_109, Z=dom_7)
dispatch_163 = Dispatch(List=box_143, DispatchPattern=m31_active)  # -> ListA, ListB
expression_314 = Expression(a=frame_section, b=num_8, Expression="a+b")
expression_315 = Expression(a=counter_height, b=num_9, Expression="a+b")
dom_110 = ConstructDomain(DomainStart=expression_314, DomainEnd=expression_315)
expression_316 = Expression(a=expression_310, b=num_10, Expression="a+b")
dom_111 = ConstructDomain(DomainStart=expression_310, DomainEnd=expression_316)
box_144 = DomainBox(Base=PlaneXY(0, 0, 0), X=dom_111, Y=dom_109, Z=dom_110)
dispatch_164 = Dispatch(List=box_144, DispatchPattern=m31_active)  # -> ListA, ListB
expression_317 = Expression(a=expression_311, b=num_11, Expression="a+b")
dom_112 = ConstructDomain(DomainStart=expression_317, DomainEnd=expression_311)
box_145 = DomainBox(Base=PlaneXY(0, 0, 0), X=dom_112, Y=dom_109, Z=dom_110)
dispatch_165 = Dispatch(List=box_145, DispatchPattern=m31_active)  # -> ListA, ListB
expression_318 = Expression(a=expression_310, b=num_10, Expression="a+b")
expression_319 = Expression(a=expression_311, b=num_11, Expression="a+b")
dom_113 = ConstructDomain(DomainStart=expression_318, DomainEnd=expression_319)
expression_320 = Expression(a=m31_active, k=m31_type, Expression="a*if(k<1.5,1,if(k>2.5,1,0))")
expression_321 = Expression(a=expression_312, b=num_10, Expression="a+b")
dom_114 = ConstructDomain(DomainStart=expression_312, DomainEnd=expression_321)
box_146 = DomainBox(Base=PlaneXY(0, 0, 0), X=dom_113, Y=dom_114, Z=dom_110)
dispatch_166 = Dispatch(List=box_146, DispatchPattern=expression_320)  # -> ListA, ListB
expression_322 = Expression(a=expression_310, b=expression_311, Expression="(a+b)/2")
expression_323 = Expression(a=expression_310, b=num_10, Expression="a+b")
expression_324 = Expression(a=expression_322, b=num_12, Expression="a+b")
dom_115 = ConstructDomain(DomainStart=expression_323, DomainEnd=expression_324)
expression_325 = Expression(a=expression_313, b=num_11, Expression="a+b")
dom_116 = ConstructDomain(DomainStart=expression_325, DomainEnd=expression_313)
box_147 = DomainBox(Base=PlaneXY(0, 0, 0), X=dom_115, Y=dom_116, Z=dom_110)
dispatch_167 = Dispatch(List=box_147, DispatchPattern=m31_active)  # -> ListA, ListB
expression_326 = Expression(a=expression_322, b=num_13, Expression="a+b")
expression_327 = Expression(a=expression_311, b=num_11, Expression="a+b")
dom_117 = ConstructDomain(DomainStart=expression_326, DomainEnd=expression_327)
expression_328 = Expression(a=expression_313, b=num_11, Expression="a+b")
dom_118 = ConstructDomain(DomainStart=expression_328, DomainEnd=expression_313)
box_148 = DomainBox(Base=PlaneXY(0, 0, 0), X=dom_117, Y=dom_118, Z=dom_110)
dispatch_168 = Dispatch(List=box_148, DispatchPattern=m31_active)  # -> ListA, ListB
expression_329 = Expression(a=m31_active, k=m31_type, Expression="a*if(k>2.5,1,0)")
expression_330 = Expression(a=m31_active, k=m31_type, n=m31_shelf_count, Expression="a*if(k>1.5,if(n>0,1,0),0)")
expression_331 = Expression(k=m31_type, c=counter_height, b=num_6, t=frame_section, Expression="if(k>2.5,c+100,b+t+60)")
expression_332 = Expression(k=m31_type, h=overall_height, c=counter_height, Expression="if(k>2.5,h-400,c-50)")
expression_333 = Expression(
    lo=expression_331,
    hi=expression_332,
    n=m31_shelf_count,
    a=m31_first_shelf,
    b=m31_last_shelf,
    Expression="max(lo,min(hi-40*max(n-1,0),min(a,b)))")
expression_334 = Expression(
    lo=expression_333,
    hi=expression_332,
    n=m31_shelf_count,
    a=m31_first_shelf,
    b=m31_last_shelf,
    Expression="max(lo+40*max(n-1,0),min(hi,max(a,b)))")
expression_335 = Expression(n=m31_shelf_count, Expression="max(1,n)")
series_3 = Series(Start=num, Step=num_2, Count=expression_335)
m31_shelf_levels = Expression(n=m31_shelf_count, a=expression_333, b=expression_334, i=series_3, Expression="if(n<1.5,a,a+(b-a)*i/max(1,n-1))")
expression_336 = Expression(a=expression_312, b=expression_313, d=shelf_depth, Expression="max(a+21,b-d-21)")
expression_337 = Expression(a=expression_310, b=num_10, Expression="a+b")
expression_338 = Expression(a=expression_311, b=num_11, Expression="a+b")
dom_119 = ConstructDomain(DomainStart=expression_337, DomainEnd=expression_338)
expression_339 = Expression(a=expression_313, b=num_14, Expression="a+b")
dom_120 = ConstructDomain(DomainStart=expression_336, DomainEnd=expression_339)
expression_340 = Expression(a=m31_shelf_levels, b=num_11, Expression="a+b")
dom_121 = ConstructDomain(DomainStart=expression_340, DomainEnd=m31_shelf_levels)
box_149 = DomainBox(Base=PlaneXY(0, 0, 0), X=dom_119, Y=dom_120, Z=dom_121)
dispatch_169 = Dispatch(List=box_149, DispatchPattern=expression_330)  # -> ListA, ListB
expression_341 = Expression(a=expression_313, b=num_15, Expression="a+b")
dom_122 = ConstructDomain(DomainStart=expression_341, DomainEnd=expression_313)
expression_342 = Expression(a=counter_height, b=num_16, Expression="a+b")
expression_343 = Expression(a=expression_334, b=num_17, Expression="a+b")
dom_123 = ConstructDomain(DomainStart=expression_342, DomainEnd=expression_343)
box_150 = DomainBox(Base=PlaneXY(0, 0, 0), X=dom_108, Y=dom_122, Z=dom_123)
dispatch_170 = Dispatch(List=box_150, DispatchPattern=expression_329)  # -> ListA, ListB
expression_344 = Expression(a=expression_6, b=expression_7, Expression="b-a")
expression_345 = Expression(a=expression, b=expression_10, Expression="b-a")
pt_28 = ConstructPoint(XCoordinate=expression_344, YCoordinate=expression_345, ZCoordinate=counter_height)
dispatch_171 = Dispatch(List=pt_28, DispatchPattern=m31_active)  # -> ListA, ListB

# ---- group: 07 M12 panels and shelves
expression_346 = Expression(x=expression, t=frame_section, Expression="x+t/2+3")
expression_347 = Expression(x=expression_5, t=frame_section, Expression="x-t/2-3")
expression_348 = Expression(y=expression_10, t=frame_section, Expression="y+t/2+3")
expression_349 = Expression(y=expression_11, t=frame_section, Expression="y-t/2-3")
dom_124 = ConstructDomain(DomainStart=expression_346, DomainEnd=expression_347)
dom_125 = ConstructDomain(DomainStart=expression_348, DomainEnd=expression_349)
box_151 = DomainBox(Base=PlaneXY(0, 0, 0), X=dom_124, Y=dom_125, Z=dom_6)
dispatch_172 = Dispatch(List=box_151, DispatchPattern=m12_active)  # -> ListA, ListB
box_152 = DomainBox(Base=PlaneXY(0, 0, 0), X=dom_124, Y=dom_125, Z=dom_7)
dispatch_173 = Dispatch(List=box_152, DispatchPattern=m12_active)  # -> ListA, ListB
expression_350 = Expression(a=frame_section, b=num_8, Expression="a+b")
expression_351 = Expression(a=counter_height, b=num_9, Expression="a+b")
dom_126 = ConstructDomain(DomainStart=expression_350, DomainEnd=expression_351)
expression_352 = Expression(a=expression_346, b=num_10, Expression="a+b")
dom_127 = ConstructDomain(DomainStart=expression_346, DomainEnd=expression_352)
box_153 = DomainBox(Base=PlaneXY(0, 0, 0), X=dom_127, Y=dom_125, Z=dom_126)
dispatch_174 = Dispatch(List=box_153, DispatchPattern=m12_active)  # -> ListA, ListB
expression_353 = Expression(a=expression_347, b=num_11, Expression="a+b")
dom_128 = ConstructDomain(DomainStart=expression_353, DomainEnd=expression_347)
box_154 = DomainBox(Base=PlaneXY(0, 0, 0), X=dom_128, Y=dom_125, Z=dom_126)
dispatch_175 = Dispatch(List=box_154, DispatchPattern=m12_active)  # -> ListA, ListB
expression_354 = Expression(a=expression_346, b=num_10, Expression="a+b")
expression_355 = Expression(a=expression_347, b=num_11, Expression="a+b")
dom_129 = ConstructDomain(DomainStart=expression_354, DomainEnd=expression_355)
expression_356 = Expression(a=m12_active, k=m12_type, Expression="a*if(k<1.5,1,if(k>2.5,1,0))")
expression_357 = Expression(a=expression_348, b=num_10, Expression="a+b")
dom_130 = ConstructDomain(DomainStart=expression_348, DomainEnd=expression_357)
box_155 = DomainBox(Base=PlaneXY(0, 0, 0), X=dom_129, Y=dom_130, Z=dom_126)
dispatch_176 = Dispatch(List=box_155, DispatchPattern=expression_356)  # -> ListA, ListB
expression_358 = Expression(a=expression_346, b=expression_347, Expression="(a+b)/2")
expression_359 = Expression(a=expression_346, b=num_10, Expression="a+b")
expression_360 = Expression(a=expression_358, b=num_12, Expression="a+b")
dom_131 = ConstructDomain(DomainStart=expression_359, DomainEnd=expression_360)
expression_361 = Expression(a=expression_349, b=num_11, Expression="a+b")
dom_132 = ConstructDomain(DomainStart=expression_361, DomainEnd=expression_349)
box_156 = DomainBox(Base=PlaneXY(0, 0, 0), X=dom_131, Y=dom_132, Z=dom_126)
dispatch_177 = Dispatch(List=box_156, DispatchPattern=m12_active)  # -> ListA, ListB
expression_362 = Expression(a=expression_358, b=num_13, Expression="a+b")
expression_363 = Expression(a=expression_347, b=num_11, Expression="a+b")
dom_133 = ConstructDomain(DomainStart=expression_362, DomainEnd=expression_363)
expression_364 = Expression(a=expression_349, b=num_11, Expression="a+b")
dom_134 = ConstructDomain(DomainStart=expression_364, DomainEnd=expression_349)
box_157 = DomainBox(Base=PlaneXY(0, 0, 0), X=dom_133, Y=dom_134, Z=dom_126)
dispatch_178 = Dispatch(List=box_157, DispatchPattern=m12_active)  # -> ListA, ListB
expression_365 = Expression(a=m12_active, k=m12_type, Expression="a*if(k>2.5,1,0)")
expression_366 = Expression(a=m12_active, k=m12_type, n=m12_shelf_count, Expression="a*if(k>1.5,if(n>0,1,0),0)")
expression_367 = Expression(k=m12_type, c=counter_height, b=num_6, t=frame_section, Expression="if(k>2.5,c+100,b+t+60)")
expression_368 = Expression(k=m12_type, h=overall_height, c=counter_height, Expression="if(k>2.5,h-400,c-50)")
expression_369 = Expression(
    lo=expression_367,
    hi=expression_368,
    n=m12_shelf_count,
    a=m12_first_shelf,
    b=m12_last_shelf,
    Expression="max(lo,min(hi-40*max(n-1,0),min(a,b)))")
expression_370 = Expression(
    lo=expression_369,
    hi=expression_368,
    n=m12_shelf_count,
    a=m12_first_shelf,
    b=m12_last_shelf,
    Expression="max(lo+40*max(n-1,0),min(hi,max(a,b)))")
expression_371 = Expression(n=m12_shelf_count, Expression="max(1,n)")
series_4 = Series(Start=num, Step=num_2, Count=expression_371)
m12_shelf_levels = Expression(n=m12_shelf_count, a=expression_369, b=expression_370, i=series_4, Expression="if(n<1.5,a,a+(b-a)*i/max(1,n-1))")
expression_372 = Expression(a=expression_348, b=expression_349, d=shelf_depth, Expression="max(a+21,b-d-21)")
expression_373 = Expression(a=expression_346, b=num_10, Expression="a+b")
expression_374 = Expression(a=expression_347, b=num_11, Expression="a+b")
dom_135 = ConstructDomain(DomainStart=expression_373, DomainEnd=expression_374)
expression_375 = Expression(a=expression_349, b=num_14, Expression="a+b")
dom_136 = ConstructDomain(DomainStart=expression_372, DomainEnd=expression_375)
expression_376 = Expression(a=m12_shelf_levels, b=num_11, Expression="a+b")
dom_137 = ConstructDomain(DomainStart=expression_376, DomainEnd=m12_shelf_levels)
box_158 = DomainBox(Base=PlaneXY(0, 0, 0), X=dom_135, Y=dom_136, Z=dom_137)
dispatch_179 = Dispatch(List=box_158, DispatchPattern=expression_366)  # -> ListA, ListB
expression_377 = Expression(a=expression_349, b=num_15, Expression="a+b")
dom_138 = ConstructDomain(DomainStart=expression_377, DomainEnd=expression_349)
expression_378 = Expression(a=counter_height, b=num_16, Expression="a+b")
expression_379 = Expression(a=expression_370, b=num_17, Expression="a+b")
dom_139 = ConstructDomain(DomainStart=expression_378, DomainEnd=expression_379)
box_159 = DomainBox(Base=PlaneXY(0, 0, 0), X=dom_124, Y=dom_138, Z=dom_139)
dispatch_180 = Dispatch(List=box_159, DispatchPattern=expression_365)  # -> ListA, ListB
expression_380 = Expression(a=expression, b=expression_5, Expression="b-a")
expression_381 = Expression(a=expression_10, b=expression_11, Expression="b-a")
pt_29 = ConstructPoint(XCoordinate=expression_380, YCoordinate=expression_381, ZCoordinate=counter_height)
dispatch_181 = Dispatch(List=pt_29, DispatchPattern=m12_active)  # -> ListA, ListB

# ---- group: 07 M22 panels and shelves
expression_382 = Expression(x=expression_5, t=frame_section, Expression="x+t/2+3")
expression_383 = Expression(x=expression_6, t=frame_section, Expression="x-t/2-3")
expression_384 = Expression(y=expression_10, t=frame_section, Expression="y+t/2+3")
expression_385 = Expression(y=expression_11, t=frame_section, Expression="y-t/2-3")
dom_140 = ConstructDomain(DomainStart=expression_382, DomainEnd=expression_383)
dom_141 = ConstructDomain(DomainStart=expression_384, DomainEnd=expression_385)
box_160 = DomainBox(Base=PlaneXY(0, 0, 0), X=dom_140, Y=dom_141, Z=dom_6)
dispatch_182 = Dispatch(List=box_160, DispatchPattern=m22_active)  # -> ListA, ListB
box_161 = DomainBox(Base=PlaneXY(0, 0, 0), X=dom_140, Y=dom_141, Z=dom_7)
dispatch_183 = Dispatch(List=box_161, DispatchPattern=m22_active)  # -> ListA, ListB
expression_386 = Expression(a=frame_section, b=num_8, Expression="a+b")
expression_387 = Expression(a=counter_height, b=num_9, Expression="a+b")
dom_142 = ConstructDomain(DomainStart=expression_386, DomainEnd=expression_387)
expression_388 = Expression(a=expression_382, b=num_10, Expression="a+b")
dom_143 = ConstructDomain(DomainStart=expression_382, DomainEnd=expression_388)
box_162 = DomainBox(Base=PlaneXY(0, 0, 0), X=dom_143, Y=dom_141, Z=dom_142)
dispatch_184 = Dispatch(List=box_162, DispatchPattern=m22_active)  # -> ListA, ListB
expression_389 = Expression(a=expression_383, b=num_11, Expression="a+b")
dom_144 = ConstructDomain(DomainStart=expression_389, DomainEnd=expression_383)
box_163 = DomainBox(Base=PlaneXY(0, 0, 0), X=dom_144, Y=dom_141, Z=dom_142)
dispatch_185 = Dispatch(List=box_163, DispatchPattern=m22_active)  # -> ListA, ListB
expression_390 = Expression(a=expression_382, b=num_10, Expression="a+b")
expression_391 = Expression(a=expression_383, b=num_11, Expression="a+b")
dom_145 = ConstructDomain(DomainStart=expression_390, DomainEnd=expression_391)
expression_392 = Expression(a=m22_active, k=m22_type, Expression="a*if(k<1.5,1,if(k>2.5,1,0))")
expression_393 = Expression(a=expression_384, b=num_10, Expression="a+b")
dom_146 = ConstructDomain(DomainStart=expression_384, DomainEnd=expression_393)
box_164 = DomainBox(Base=PlaneXY(0, 0, 0), X=dom_145, Y=dom_146, Z=dom_142)
dispatch_186 = Dispatch(List=box_164, DispatchPattern=expression_392)  # -> ListA, ListB
expression_394 = Expression(a=expression_382, b=expression_383, Expression="(a+b)/2")
expression_395 = Expression(a=expression_382, b=num_10, Expression="a+b")
expression_396 = Expression(a=expression_394, b=num_12, Expression="a+b")
dom_147 = ConstructDomain(DomainStart=expression_395, DomainEnd=expression_396)
expression_397 = Expression(a=expression_385, b=num_11, Expression="a+b")
dom_148 = ConstructDomain(DomainStart=expression_397, DomainEnd=expression_385)
box_165 = DomainBox(Base=PlaneXY(0, 0, 0), X=dom_147, Y=dom_148, Z=dom_142)
dispatch_187 = Dispatch(List=box_165, DispatchPattern=m22_active)  # -> ListA, ListB
expression_398 = Expression(a=expression_394, b=num_13, Expression="a+b")
expression_399 = Expression(a=expression_383, b=num_11, Expression="a+b")
dom_149 = ConstructDomain(DomainStart=expression_398, DomainEnd=expression_399)
expression_400 = Expression(a=expression_385, b=num_11, Expression="a+b")
dom_150 = ConstructDomain(DomainStart=expression_400, DomainEnd=expression_385)
box_166 = DomainBox(Base=PlaneXY(0, 0, 0), X=dom_149, Y=dom_150, Z=dom_142)
dispatch_188 = Dispatch(List=box_166, DispatchPattern=m22_active)  # -> ListA, ListB
expression_401 = Expression(a=m22_active, k=m22_type, Expression="a*if(k>2.5,1,0)")
expression_402 = Expression(a=m22_active, k=m22_type, n=m22_shelf_count, Expression="a*if(k>1.5,if(n>0,1,0),0)")
expression_403 = Expression(k=m22_type, c=counter_height, b=num_6, t=frame_section, Expression="if(k>2.5,c+100,b+t+60)")
expression_404 = Expression(k=m22_type, h=overall_height, c=counter_height, Expression="if(k>2.5,h-400,c-50)")
expression_405 = Expression(
    lo=expression_403,
    hi=expression_404,
    n=m22_shelf_count,
    a=m22_first_shelf,
    b=m22_last_shelf,
    Expression="max(lo,min(hi-40*max(n-1,0),min(a,b)))")
expression_406 = Expression(
    lo=expression_405,
    hi=expression_404,
    n=m22_shelf_count,
    a=m22_first_shelf,
    b=m22_last_shelf,
    Expression="max(lo+40*max(n-1,0),min(hi,max(a,b)))")
expression_407 = Expression(n=m22_shelf_count, Expression="max(1,n)")
series_5 = Series(Start=num, Step=num_2, Count=expression_407)
m22_shelf_levels = Expression(n=m22_shelf_count, a=expression_405, b=expression_406, i=series_5, Expression="if(n<1.5,a,a+(b-a)*i/max(1,n-1))")
expression_408 = Expression(a=expression_384, b=expression_385, d=shelf_depth, Expression="max(a+21,b-d-21)")
expression_409 = Expression(a=expression_382, b=num_10, Expression="a+b")
expression_410 = Expression(a=expression_383, b=num_11, Expression="a+b")
dom_151 = ConstructDomain(DomainStart=expression_409, DomainEnd=expression_410)
expression_411 = Expression(a=expression_385, b=num_14, Expression="a+b")
dom_152 = ConstructDomain(DomainStart=expression_408, DomainEnd=expression_411)
expression_412 = Expression(a=m22_shelf_levels, b=num_11, Expression="a+b")
dom_153 = ConstructDomain(DomainStart=expression_412, DomainEnd=m22_shelf_levels)
box_167 = DomainBox(Base=PlaneXY(0, 0, 0), X=dom_151, Y=dom_152, Z=dom_153)
dispatch_189 = Dispatch(List=box_167, DispatchPattern=expression_402)  # -> ListA, ListB
expression_413 = Expression(a=expression_385, b=num_15, Expression="a+b")
dom_154 = ConstructDomain(DomainStart=expression_413, DomainEnd=expression_385)
expression_414 = Expression(a=counter_height, b=num_16, Expression="a+b")
expression_415 = Expression(a=expression_406, b=num_17, Expression="a+b")
dom_155 = ConstructDomain(DomainStart=expression_414, DomainEnd=expression_415)
box_168 = DomainBox(Base=PlaneXY(0, 0, 0), X=dom_140, Y=dom_154, Z=dom_155)
dispatch_190 = Dispatch(List=box_168, DispatchPattern=expression_401)  # -> ListA, ListB
expression_416 = Expression(a=expression_5, b=expression_6, Expression="b-a")
expression_417 = Expression(a=expression_10, b=expression_11, Expression="b-a")
pt_30 = ConstructPoint(XCoordinate=expression_416, YCoordinate=expression_417, ZCoordinate=counter_height)
dispatch_191 = Dispatch(List=pt_30, DispatchPattern=m22_active)  # -> ListA, ListB

# ---- group: 07 M32 panels and shelves
expression_418 = Expression(x=expression_6, t=frame_section, Expression="x+t/2+3")
expression_419 = Expression(x=expression_7, t=frame_section, Expression="x-t/2-3")
expression_420 = Expression(y=expression_10, t=frame_section, Expression="y+t/2+3")
expression_421 = Expression(y=expression_11, t=frame_section, Expression="y-t/2-3")
dom_156 = ConstructDomain(DomainStart=expression_418, DomainEnd=expression_419)
dom_157 = ConstructDomain(DomainStart=expression_420, DomainEnd=expression_421)
box_169 = DomainBox(Base=PlaneXY(0, 0, 0), X=dom_156, Y=dom_157, Z=dom_6)
dispatch_192 = Dispatch(List=box_169, DispatchPattern=m32_active)  # -> ListA, ListB
box_170 = DomainBox(Base=PlaneXY(0, 0, 0), X=dom_156, Y=dom_157, Z=dom_7)
dispatch_193 = Dispatch(List=box_170, DispatchPattern=m32_active)  # -> ListA, ListB
expression_422 = Expression(a=frame_section, b=num_8, Expression="a+b")
expression_423 = Expression(a=counter_height, b=num_9, Expression="a+b")
dom_158 = ConstructDomain(DomainStart=expression_422, DomainEnd=expression_423)
expression_424 = Expression(a=expression_418, b=num_10, Expression="a+b")
dom_159 = ConstructDomain(DomainStart=expression_418, DomainEnd=expression_424)
box_171 = DomainBox(Base=PlaneXY(0, 0, 0), X=dom_159, Y=dom_157, Z=dom_158)
dispatch_194 = Dispatch(List=box_171, DispatchPattern=m32_active)  # -> ListA, ListB
expression_425 = Expression(a=expression_419, b=num_11, Expression="a+b")
dom_160 = ConstructDomain(DomainStart=expression_425, DomainEnd=expression_419)
box_172 = DomainBox(Base=PlaneXY(0, 0, 0), X=dom_160, Y=dom_157, Z=dom_158)
dispatch_195 = Dispatch(List=box_172, DispatchPattern=m32_active)  # -> ListA, ListB
expression_426 = Expression(a=expression_418, b=num_10, Expression="a+b")
expression_427 = Expression(a=expression_419, b=num_11, Expression="a+b")
dom_161 = ConstructDomain(DomainStart=expression_426, DomainEnd=expression_427)
expression_428 = Expression(a=m32_active, k=m32_type, Expression="a*if(k<1.5,1,if(k>2.5,1,0))")
expression_429 = Expression(a=expression_420, b=num_10, Expression="a+b")
dom_162 = ConstructDomain(DomainStart=expression_420, DomainEnd=expression_429)
box_173 = DomainBox(Base=PlaneXY(0, 0, 0), X=dom_161, Y=dom_162, Z=dom_158)
dispatch_196 = Dispatch(List=box_173, DispatchPattern=expression_428)  # -> ListA, ListB
expression_430 = Expression(a=expression_418, b=expression_419, Expression="(a+b)/2")
expression_431 = Expression(a=expression_418, b=num_10, Expression="a+b")
expression_432 = Expression(a=expression_430, b=num_12, Expression="a+b")
dom_163 = ConstructDomain(DomainStart=expression_431, DomainEnd=expression_432)
expression_433 = Expression(a=expression_421, b=num_11, Expression="a+b")
dom_164 = ConstructDomain(DomainStart=expression_433, DomainEnd=expression_421)
box_174 = DomainBox(Base=PlaneXY(0, 0, 0), X=dom_163, Y=dom_164, Z=dom_158)
dispatch_197 = Dispatch(List=box_174, DispatchPattern=m32_active)  # -> ListA, ListB
expression_434 = Expression(a=expression_430, b=num_13, Expression="a+b")
expression_435 = Expression(a=expression_419, b=num_11, Expression="a+b")
dom_165 = ConstructDomain(DomainStart=expression_434, DomainEnd=expression_435)
expression_436 = Expression(a=expression_421, b=num_11, Expression="a+b")
dom_166 = ConstructDomain(DomainStart=expression_436, DomainEnd=expression_421)
box_175 = DomainBox(Base=PlaneXY(0, 0, 0), X=dom_165, Y=dom_166, Z=dom_158)
dispatch_198 = Dispatch(List=box_175, DispatchPattern=m32_active)  # -> ListA, ListB
expression_437 = Expression(a=m32_active, k=m32_type, Expression="a*if(k>2.5,1,0)")
expression_438 = Expression(a=m32_active, k=m32_type, n=m32_shelf_count, Expression="a*if(k>1.5,if(n>0,1,0),0)")
expression_439 = Expression(k=m32_type, c=counter_height, b=num_6, t=frame_section, Expression="if(k>2.5,c+100,b+t+60)")
expression_440 = Expression(k=m32_type, h=overall_height, c=counter_height, Expression="if(k>2.5,h-400,c-50)")
expression_441 = Expression(
    lo=expression_439,
    hi=expression_440,
    n=m32_shelf_count,
    a=m32_first_shelf,
    b=m32_last_shelf,
    Expression="max(lo,min(hi-40*max(n-1,0),min(a,b)))")
expression_442 = Expression(
    lo=expression_441,
    hi=expression_440,
    n=m32_shelf_count,
    a=m32_first_shelf,
    b=m32_last_shelf,
    Expression="max(lo+40*max(n-1,0),min(hi,max(a,b)))")
expression_443 = Expression(n=m32_shelf_count, Expression="max(1,n)")
series_6 = Series(Start=num, Step=num_2, Count=expression_443)
m32_shelf_levels = Expression(n=m32_shelf_count, a=expression_441, b=expression_442, i=series_6, Expression="if(n<1.5,a,a+(b-a)*i/max(1,n-1))")
expression_444 = Expression(a=expression_420, b=expression_421, d=shelf_depth, Expression="max(a+21,b-d-21)")
expression_445 = Expression(a=expression_418, b=num_10, Expression="a+b")
expression_446 = Expression(a=expression_419, b=num_11, Expression="a+b")
dom_167 = ConstructDomain(DomainStart=expression_445, DomainEnd=expression_446)
expression_447 = Expression(a=expression_421, b=num_14, Expression="a+b")
dom_168 = ConstructDomain(DomainStart=expression_444, DomainEnd=expression_447)
expression_448 = Expression(a=m32_shelf_levels, b=num_11, Expression="a+b")
dom_169 = ConstructDomain(DomainStart=expression_448, DomainEnd=m32_shelf_levels)
box_176 = DomainBox(Base=PlaneXY(0, 0, 0), X=dom_167, Y=dom_168, Z=dom_169)
dispatch_199 = Dispatch(List=box_176, DispatchPattern=expression_438)  # -> ListA, ListB
expression_449 = Expression(a=expression_421, b=num_15, Expression="a+b")
dom_170 = ConstructDomain(DomainStart=expression_449, DomainEnd=expression_421)
expression_450 = Expression(a=counter_height, b=num_16, Expression="a+b")
expression_451 = Expression(a=expression_442, b=num_17, Expression="a+b")
dom_171 = ConstructDomain(DomainStart=expression_450, DomainEnd=expression_451)
box_177 = DomainBox(Base=PlaneXY(0, 0, 0), X=dom_156, Y=dom_170, Z=dom_171)
dispatch_200 = Dispatch(List=box_177, DispatchPattern=expression_437)  # -> ListA, ListB
expression_452 = Expression(a=expression_6, b=expression_7, Expression="b-a")
expression_453 = Expression(a=expression_10, b=expression_11, Expression="b-a")
pt_31 = ConstructPoint(XCoordinate=expression_452, YCoordinate=expression_453, ZCoordinate=counter_height)
dispatch_201 = Dispatch(List=pt_31, DispatchPattern=m32_active)  # -> ListA, ListB

# ---- group: 07 M13 panels and shelves
expression_454 = Expression(x=expression, t=frame_section, Expression="x+t/2+3")
expression_455 = Expression(x=expression_5, t=frame_section, Expression="x-t/2-3")
expression_456 = Expression(y=expression_11, t=frame_section, Expression="y+t/2+3")
expression_457 = Expression(y=expression_12, t=frame_section, Expression="y-t/2-3")
dom_172 = ConstructDomain(DomainStart=expression_454, DomainEnd=expression_455)
dom_173 = ConstructDomain(DomainStart=expression_456, DomainEnd=expression_457)
box_178 = DomainBox(Base=PlaneXY(0, 0, 0), X=dom_172, Y=dom_173, Z=dom_6)
dispatch_202 = Dispatch(List=box_178, DispatchPattern=m13_active)  # -> ListA, ListB
box_179 = DomainBox(Base=PlaneXY(0, 0, 0), X=dom_172, Y=dom_173, Z=dom_7)
dispatch_203 = Dispatch(List=box_179, DispatchPattern=m13_active)  # -> ListA, ListB
expression_458 = Expression(a=frame_section, b=num_8, Expression="a+b")
expression_459 = Expression(a=counter_height, b=num_9, Expression="a+b")
dom_174 = ConstructDomain(DomainStart=expression_458, DomainEnd=expression_459)
expression_460 = Expression(a=expression_454, b=num_10, Expression="a+b")
dom_175 = ConstructDomain(DomainStart=expression_454, DomainEnd=expression_460)
box_180 = DomainBox(Base=PlaneXY(0, 0, 0), X=dom_175, Y=dom_173, Z=dom_174)
dispatch_204 = Dispatch(List=box_180, DispatchPattern=m13_active)  # -> ListA, ListB
expression_461 = Expression(a=expression_455, b=num_11, Expression="a+b")
dom_176 = ConstructDomain(DomainStart=expression_461, DomainEnd=expression_455)
box_181 = DomainBox(Base=PlaneXY(0, 0, 0), X=dom_176, Y=dom_173, Z=dom_174)
dispatch_205 = Dispatch(List=box_181, DispatchPattern=m13_active)  # -> ListA, ListB
expression_462 = Expression(a=expression_454, b=num_10, Expression="a+b")
expression_463 = Expression(a=expression_455, b=num_11, Expression="a+b")
dom_177 = ConstructDomain(DomainStart=expression_462, DomainEnd=expression_463)
expression_464 = Expression(a=m13_active, k=m13_type, Expression="a*if(k<1.5,1,if(k>2.5,1,0))")
expression_465 = Expression(a=expression_456, b=num_10, Expression="a+b")
dom_178 = ConstructDomain(DomainStart=expression_456, DomainEnd=expression_465)
box_182 = DomainBox(Base=PlaneXY(0, 0, 0), X=dom_177, Y=dom_178, Z=dom_174)
dispatch_206 = Dispatch(List=box_182, DispatchPattern=expression_464)  # -> ListA, ListB
expression_466 = Expression(a=expression_454, b=expression_455, Expression="(a+b)/2")
expression_467 = Expression(a=expression_454, b=num_10, Expression="a+b")
expression_468 = Expression(a=expression_466, b=num_12, Expression="a+b")
dom_179 = ConstructDomain(DomainStart=expression_467, DomainEnd=expression_468)
expression_469 = Expression(a=expression_457, b=num_11, Expression="a+b")
dom_180 = ConstructDomain(DomainStart=expression_469, DomainEnd=expression_457)
box_183 = DomainBox(Base=PlaneXY(0, 0, 0), X=dom_179, Y=dom_180, Z=dom_174)
dispatch_207 = Dispatch(List=box_183, DispatchPattern=m13_active)  # -> ListA, ListB
expression_470 = Expression(a=expression_466, b=num_13, Expression="a+b")
expression_471 = Expression(a=expression_455, b=num_11, Expression="a+b")
dom_181 = ConstructDomain(DomainStart=expression_470, DomainEnd=expression_471)
expression_472 = Expression(a=expression_457, b=num_11, Expression="a+b")
dom_182 = ConstructDomain(DomainStart=expression_472, DomainEnd=expression_457)
box_184 = DomainBox(Base=PlaneXY(0, 0, 0), X=dom_181, Y=dom_182, Z=dom_174)
dispatch_208 = Dispatch(List=box_184, DispatchPattern=m13_active)  # -> ListA, ListB
expression_473 = Expression(a=m13_active, k=m13_type, Expression="a*if(k>2.5,1,0)")
expression_474 = Expression(a=m13_active, k=m13_type, n=m13_shelf_count, Expression="a*if(k>1.5,if(n>0,1,0),0)")
expression_475 = Expression(k=m13_type, c=counter_height, b=num_6, t=frame_section, Expression="if(k>2.5,c+100,b+t+60)")
expression_476 = Expression(k=m13_type, h=overall_height, c=counter_height, Expression="if(k>2.5,h-400,c-50)")
expression_477 = Expression(
    lo=expression_475,
    hi=expression_476,
    n=m13_shelf_count,
    a=m13_first_shelf,
    b=m13_last_shelf,
    Expression="max(lo,min(hi-40*max(n-1,0),min(a,b)))")
expression_478 = Expression(
    lo=expression_477,
    hi=expression_476,
    n=m13_shelf_count,
    a=m13_first_shelf,
    b=m13_last_shelf,
    Expression="max(lo+40*max(n-1,0),min(hi,max(a,b)))")
expression_479 = Expression(n=m13_shelf_count, Expression="max(1,n)")
series_7 = Series(Start=num, Step=num_2, Count=expression_479)
m13_shelf_levels = Expression(n=m13_shelf_count, a=expression_477, b=expression_478, i=series_7, Expression="if(n<1.5,a,a+(b-a)*i/max(1,n-1))")
expression_480 = Expression(a=expression_456, b=expression_457, d=shelf_depth, Expression="max(a+21,b-d-21)")
expression_481 = Expression(a=expression_454, b=num_10, Expression="a+b")
expression_482 = Expression(a=expression_455, b=num_11, Expression="a+b")
dom_183 = ConstructDomain(DomainStart=expression_481, DomainEnd=expression_482)
expression_483 = Expression(a=expression_457, b=num_14, Expression="a+b")
dom_184 = ConstructDomain(DomainStart=expression_480, DomainEnd=expression_483)
expression_484 = Expression(a=m13_shelf_levels, b=num_11, Expression="a+b")
dom_185 = ConstructDomain(DomainStart=expression_484, DomainEnd=m13_shelf_levels)
box_185 = DomainBox(Base=PlaneXY(0, 0, 0), X=dom_183, Y=dom_184, Z=dom_185)
dispatch_209 = Dispatch(List=box_185, DispatchPattern=expression_474)  # -> ListA, ListB
expression_485 = Expression(a=expression_457, b=num_15, Expression="a+b")
dom_186 = ConstructDomain(DomainStart=expression_485, DomainEnd=expression_457)
expression_486 = Expression(a=counter_height, b=num_16, Expression="a+b")
expression_487 = Expression(a=expression_478, b=num_17, Expression="a+b")
dom_187 = ConstructDomain(DomainStart=expression_486, DomainEnd=expression_487)
box_186 = DomainBox(Base=PlaneXY(0, 0, 0), X=dom_172, Y=dom_186, Z=dom_187)
dispatch_210 = Dispatch(List=box_186, DispatchPattern=expression_473)  # -> ListA, ListB
expression_488 = Expression(a=expression, b=expression_5, Expression="b-a")
expression_489 = Expression(a=expression_11, b=expression_12, Expression="b-a")
pt_32 = ConstructPoint(XCoordinate=expression_488, YCoordinate=expression_489, ZCoordinate=counter_height)
dispatch_211 = Dispatch(List=pt_32, DispatchPattern=m13_active)  # -> ListA, ListB

# ---- group: 07 M23 panels and shelves
expression_490 = Expression(x=expression_5, t=frame_section, Expression="x+t/2+3")
expression_491 = Expression(x=expression_6, t=frame_section, Expression="x-t/2-3")
expression_492 = Expression(y=expression_11, t=frame_section, Expression="y+t/2+3")
expression_493 = Expression(y=expression_12, t=frame_section, Expression="y-t/2-3")
dom_188 = ConstructDomain(DomainStart=expression_490, DomainEnd=expression_491)
dom_189 = ConstructDomain(DomainStart=expression_492, DomainEnd=expression_493)
box_187 = DomainBox(Base=PlaneXY(0, 0, 0), X=dom_188, Y=dom_189, Z=dom_6)
dispatch_212 = Dispatch(List=box_187, DispatchPattern=m23_active)  # -> ListA, ListB
box_188 = DomainBox(Base=PlaneXY(0, 0, 0), X=dom_188, Y=dom_189, Z=dom_7)
dispatch_213 = Dispatch(List=box_188, DispatchPattern=m23_active)  # -> ListA, ListB
expression_494 = Expression(a=frame_section, b=num_8, Expression="a+b")
expression_495 = Expression(a=counter_height, b=num_9, Expression="a+b")
dom_190 = ConstructDomain(DomainStart=expression_494, DomainEnd=expression_495)
expression_496 = Expression(a=expression_490, b=num_10, Expression="a+b")
dom_191 = ConstructDomain(DomainStart=expression_490, DomainEnd=expression_496)
box_189 = DomainBox(Base=PlaneXY(0, 0, 0), X=dom_191, Y=dom_189, Z=dom_190)
dispatch_214 = Dispatch(List=box_189, DispatchPattern=m23_active)  # -> ListA, ListB
expression_497 = Expression(a=expression_491, b=num_11, Expression="a+b")
dom_192 = ConstructDomain(DomainStart=expression_497, DomainEnd=expression_491)
box_190 = DomainBox(Base=PlaneXY(0, 0, 0), X=dom_192, Y=dom_189, Z=dom_190)
dispatch_215 = Dispatch(List=box_190, DispatchPattern=m23_active)  # -> ListA, ListB
expression_498 = Expression(a=expression_490, b=num_10, Expression="a+b")
expression_499 = Expression(a=expression_491, b=num_11, Expression="a+b")
dom_193 = ConstructDomain(DomainStart=expression_498, DomainEnd=expression_499)
expression_500 = Expression(a=m23_active, k=m23_type, Expression="a*if(k<1.5,1,if(k>2.5,1,0))")
expression_501 = Expression(a=expression_492, b=num_10, Expression="a+b")
dom_194 = ConstructDomain(DomainStart=expression_492, DomainEnd=expression_501)
box_191 = DomainBox(Base=PlaneXY(0, 0, 0), X=dom_193, Y=dom_194, Z=dom_190)
dispatch_216 = Dispatch(List=box_191, DispatchPattern=expression_500)  # -> ListA, ListB
expression_502 = Expression(a=expression_490, b=expression_491, Expression="(a+b)/2")
expression_503 = Expression(a=expression_490, b=num_10, Expression="a+b")
expression_504 = Expression(a=expression_502, b=num_12, Expression="a+b")
dom_195 = ConstructDomain(DomainStart=expression_503, DomainEnd=expression_504)
expression_505 = Expression(a=expression_493, b=num_11, Expression="a+b")
dom_196 = ConstructDomain(DomainStart=expression_505, DomainEnd=expression_493)
box_192 = DomainBox(Base=PlaneXY(0, 0, 0), X=dom_195, Y=dom_196, Z=dom_190)
dispatch_217 = Dispatch(List=box_192, DispatchPattern=m23_active)  # -> ListA, ListB
expression_506 = Expression(a=expression_502, b=num_13, Expression="a+b")
expression_507 = Expression(a=expression_491, b=num_11, Expression="a+b")
dom_197 = ConstructDomain(DomainStart=expression_506, DomainEnd=expression_507)
expression_508 = Expression(a=expression_493, b=num_11, Expression="a+b")
dom_198 = ConstructDomain(DomainStart=expression_508, DomainEnd=expression_493)
box_193 = DomainBox(Base=PlaneXY(0, 0, 0), X=dom_197, Y=dom_198, Z=dom_190)
dispatch_218 = Dispatch(List=box_193, DispatchPattern=m23_active)  # -> ListA, ListB
expression_509 = Expression(a=m23_active, k=m23_type, Expression="a*if(k>2.5,1,0)")
expression_510 = Expression(a=m23_active, k=m23_type, n=m23_shelf_count, Expression="a*if(k>1.5,if(n>0,1,0),0)")
expression_511 = Expression(k=m23_type, c=counter_height, b=num_6, t=frame_section, Expression="if(k>2.5,c+100,b+t+60)")
expression_512 = Expression(k=m23_type, h=overall_height, c=counter_height, Expression="if(k>2.5,h-400,c-50)")
expression_513 = Expression(
    lo=expression_511,
    hi=expression_512,
    n=m23_shelf_count,
    a=m23_first_shelf,
    b=m23_last_shelf,
    Expression="max(lo,min(hi-40*max(n-1,0),min(a,b)))")
expression_514 = Expression(
    lo=expression_513,
    hi=expression_512,
    n=m23_shelf_count,
    a=m23_first_shelf,
    b=m23_last_shelf,
    Expression="max(lo+40*max(n-1,0),min(hi,max(a,b)))")
expression_515 = Expression(n=m23_shelf_count, Expression="max(1,n)")
series_8 = Series(Start=num, Step=num_2, Count=expression_515)
m23_shelf_levels = Expression(n=m23_shelf_count, a=expression_513, b=expression_514, i=series_8, Expression="if(n<1.5,a,a+(b-a)*i/max(1,n-1))")
expression_516 = Expression(a=expression_492, b=expression_493, d=shelf_depth, Expression="max(a+21,b-d-21)")
expression_517 = Expression(a=expression_490, b=num_10, Expression="a+b")
expression_518 = Expression(a=expression_491, b=num_11, Expression="a+b")
dom_199 = ConstructDomain(DomainStart=expression_517, DomainEnd=expression_518)
expression_519 = Expression(a=expression_493, b=num_14, Expression="a+b")
dom_200 = ConstructDomain(DomainStart=expression_516, DomainEnd=expression_519)
expression_520 = Expression(a=m23_shelf_levels, b=num_11, Expression="a+b")
dom_201 = ConstructDomain(DomainStart=expression_520, DomainEnd=m23_shelf_levels)
box_194 = DomainBox(Base=PlaneXY(0, 0, 0), X=dom_199, Y=dom_200, Z=dom_201)
dispatch_219 = Dispatch(List=box_194, DispatchPattern=expression_510)  # -> ListA, ListB
expression_521 = Expression(a=expression_493, b=num_15, Expression="a+b")
dom_202 = ConstructDomain(DomainStart=expression_521, DomainEnd=expression_493)
expression_522 = Expression(a=counter_height, b=num_16, Expression="a+b")
expression_523 = Expression(a=expression_514, b=num_17, Expression="a+b")
dom_203 = ConstructDomain(DomainStart=expression_522, DomainEnd=expression_523)
box_195 = DomainBox(Base=PlaneXY(0, 0, 0), X=dom_188, Y=dom_202, Z=dom_203)
dispatch_220 = Dispatch(List=box_195, DispatchPattern=expression_509)  # -> ListA, ListB
expression_524 = Expression(a=expression_5, b=expression_6, Expression="b-a")
expression_525 = Expression(a=expression_11, b=expression_12, Expression="b-a")
pt_33 = ConstructPoint(XCoordinate=expression_524, YCoordinate=expression_525, ZCoordinate=counter_height)
dispatch_221 = Dispatch(List=pt_33, DispatchPattern=m23_active)  # -> ListA, ListB

# ---- group: 07 M33 panels and shelves
expression_526 = Expression(x=expression_6, t=frame_section, Expression="x+t/2+3")
expression_527 = Expression(x=expression_7, t=frame_section, Expression="x-t/2-3")
expression_528 = Expression(y=expression_11, t=frame_section, Expression="y+t/2+3")
expression_529 = Expression(y=expression_12, t=frame_section, Expression="y-t/2-3")
dom_204 = ConstructDomain(DomainStart=expression_526, DomainEnd=expression_527)
dom_205 = ConstructDomain(DomainStart=expression_528, DomainEnd=expression_529)
box_196 = DomainBox(Base=PlaneXY(0, 0, 0), X=dom_204, Y=dom_205, Z=dom_6)
dispatch_222 = Dispatch(List=box_196, DispatchPattern=m33_active)  # -> ListA, ListB
box_197 = DomainBox(Base=PlaneXY(0, 0, 0), X=dom_204, Y=dom_205, Z=dom_7)
dispatch_223 = Dispatch(List=box_197, DispatchPattern=m33_active)  # -> ListA, ListB
expression_530 = Expression(a=frame_section, b=num_8, Expression="a+b")
expression_531 = Expression(a=counter_height, b=num_9, Expression="a+b")
dom_206 = ConstructDomain(DomainStart=expression_530, DomainEnd=expression_531)
expression_532 = Expression(a=expression_526, b=num_10, Expression="a+b")
dom_207 = ConstructDomain(DomainStart=expression_526, DomainEnd=expression_532)
box_198 = DomainBox(Base=PlaneXY(0, 0, 0), X=dom_207, Y=dom_205, Z=dom_206)
dispatch_224 = Dispatch(List=box_198, DispatchPattern=m33_active)  # -> ListA, ListB
expression_533 = Expression(a=expression_527, b=num_11, Expression="a+b")
dom_208 = ConstructDomain(DomainStart=expression_533, DomainEnd=expression_527)
box_199 = DomainBox(Base=PlaneXY(0, 0, 0), X=dom_208, Y=dom_205, Z=dom_206)
dispatch_225 = Dispatch(List=box_199, DispatchPattern=m33_active)  # -> ListA, ListB
expression_534 = Expression(a=expression_526, b=num_10, Expression="a+b")
expression_535 = Expression(a=expression_527, b=num_11, Expression="a+b")
dom_209 = ConstructDomain(DomainStart=expression_534, DomainEnd=expression_535)
expression_536 = Expression(a=m33_active, k=m33_type, Expression="a*if(k<1.5,1,if(k>2.5,1,0))")
expression_537 = Expression(a=expression_528, b=num_10, Expression="a+b")
dom_210 = ConstructDomain(DomainStart=expression_528, DomainEnd=expression_537)
box_200 = DomainBox(Base=PlaneXY(0, 0, 0), X=dom_209, Y=dom_210, Z=dom_206)
dispatch_226 = Dispatch(List=box_200, DispatchPattern=expression_536)  # -> ListA, ListB
expression_538 = Expression(a=expression_526, b=expression_527, Expression="(a+b)/2")
expression_539 = Expression(a=expression_526, b=num_10, Expression="a+b")
expression_540 = Expression(a=expression_538, b=num_12, Expression="a+b")
dom_211 = ConstructDomain(DomainStart=expression_539, DomainEnd=expression_540)
expression_541 = Expression(a=expression_529, b=num_11, Expression="a+b")
dom_212 = ConstructDomain(DomainStart=expression_541, DomainEnd=expression_529)
box_201 = DomainBox(Base=PlaneXY(0, 0, 0), X=dom_211, Y=dom_212, Z=dom_206)
dispatch_227 = Dispatch(List=box_201, DispatchPattern=m33_active)  # -> ListA, ListB
expression_542 = Expression(a=expression_538, b=num_13, Expression="a+b")
expression_543 = Expression(a=expression_527, b=num_11, Expression="a+b")
dom_213 = ConstructDomain(DomainStart=expression_542, DomainEnd=expression_543)
expression_544 = Expression(a=expression_529, b=num_11, Expression="a+b")
dom_214 = ConstructDomain(DomainStart=expression_544, DomainEnd=expression_529)
box_202 = DomainBox(Base=PlaneXY(0, 0, 0), X=dom_213, Y=dom_214, Z=dom_206)
dispatch_228 = Dispatch(List=box_202, DispatchPattern=m33_active)  # -> ListA, ListB
expression_545 = Expression(a=m33_active, k=m33_type, Expression="a*if(k>2.5,1,0)")
expression_546 = Expression(a=m33_active, k=m33_type, n=m33_shelf_count, Expression="a*if(k>1.5,if(n>0,1,0),0)")
expression_547 = Expression(k=m33_type, c=counter_height, b=num_6, t=frame_section, Expression="if(k>2.5,c+100,b+t+60)")
expression_548 = Expression(k=m33_type, h=overall_height, c=counter_height, Expression="if(k>2.5,h-400,c-50)")
expression_549 = Expression(
    lo=expression_547,
    hi=expression_548,
    n=m33_shelf_count,
    a=m33_first_shelf,
    b=m33_last_shelf,
    Expression="max(lo,min(hi-40*max(n-1,0),min(a,b)))")
expression_550 = Expression(
    lo=expression_549,
    hi=expression_548,
    n=m33_shelf_count,
    a=m33_first_shelf,
    b=m33_last_shelf,
    Expression="max(lo+40*max(n-1,0),min(hi,max(a,b)))")
expression_551 = Expression(n=m33_shelf_count, Expression="max(1,n)")
series_9 = Series(Start=num, Step=num_2, Count=expression_551)
m33_shelf_levels = Expression(n=m33_shelf_count, a=expression_549, b=expression_550, i=series_9, Expression="if(n<1.5,a,a+(b-a)*i/max(1,n-1))")
expression_552 = Expression(a=expression_528, b=expression_529, d=shelf_depth, Expression="max(a+21,b-d-21)")
expression_553 = Expression(a=expression_526, b=num_10, Expression="a+b")
expression_554 = Expression(a=expression_527, b=num_11, Expression="a+b")
dom_215 = ConstructDomain(DomainStart=expression_553, DomainEnd=expression_554)
expression_555 = Expression(a=expression_529, b=num_14, Expression="a+b")
dom_216 = ConstructDomain(DomainStart=expression_552, DomainEnd=expression_555)
expression_556 = Expression(a=m33_shelf_levels, b=num_11, Expression="a+b")
dom_217 = ConstructDomain(DomainStart=expression_556, DomainEnd=m33_shelf_levels)
box_203 = DomainBox(Base=PlaneXY(0, 0, 0), X=dom_215, Y=dom_216, Z=dom_217)
dispatch_229 = Dispatch(List=box_203, DispatchPattern=expression_546)  # -> ListA, ListB
expression_557 = Expression(a=expression_529, b=num_15, Expression="a+b")
dom_218 = ConstructDomain(DomainStart=expression_557, DomainEnd=expression_529)
expression_558 = Expression(a=counter_height, b=num_16, Expression="a+b")
expression_559 = Expression(a=expression_550, b=num_17, Expression="a+b")
dom_219 = ConstructDomain(DomainStart=expression_558, DomainEnd=expression_559)
box_204 = DomainBox(Base=PlaneXY(0, 0, 0), X=dom_204, Y=dom_218, Z=dom_219)
dispatch_230 = Dispatch(List=box_204, DispatchPattern=expression_545)  # -> ListA, ListB
expression_560 = Expression(a=expression_6, b=expression_7, Expression="b-a")
expression_561 = Expression(a=expression_11, b=expression_12, Expression="b-a")
pt_34 = ConstructPoint(XCoordinate=expression_560, YCoordinate=expression_561, ZCoordinate=counter_height)
dispatch_231 = Dispatch(List=pt_34, DispatchPattern=m33_active)  # -> ListA, ListB

# ---- group: 09 Outputs - right-click to bake
# Fabrication scope: Shared columns and rails are generated once.
# Beams stop at column faces; empty cells stay open.
# Caster CAD height = 146.27 mm; catalog = 148 mm.
# Mounts are 6 mm adapter blanks; drilling pending.
# Confirm load, stability, locks, joints and elevator clearances before fabrication.
col_3 = Colour(RGB(40, 42, 43))
col_4 = Colour(RGB(110, 115, 120))
col_5 = Colour(RGB(179, 131, 78))
col_6 = Colour(RGB(151, 111, 70))
col_7 = Colour(RGB(200, 155, 97))
col_8 = Colour(RGB(221, 213, 194))
col_9 = Colour(RGB(35, 37, 38))
col_10 = Colour(RGB(105, 110, 115))
frame_merge = Merge(Data1=[dispatch_11.ListA, dispatch_12.ListA, dispatch_13.ListA, dispatch_14.ListA, dispatch_15.ListA, dispatch_16.ListA, dispatch_17.ListA, dispatch_18.ListA, dispatch_19.ListA, dispatch_20.ListA, dispatch_21.ListA, dispatch_22.ListA, dispatch_23.ListA, dispatch_24.ListA, dispatch_25.ListA, dispatch_26.ListA, dispatch_27.ListA, dispatch_28.ListA, dispatch_29.ListA, dispatch_30.ListA, dispatch_31.ListA, dispatch_32.ListA, dispatch_33.ListA, dispatch_34.ListA, dispatch_35.ListA, dispatch_36.ListA, dispatch_37.ListA, dispatch_38.ListA, dispatch_39.ListA, dispatch_40.ListA, dispatch_41.ListA, dispatch_42.ListA, dispatch_43.ListA, dispatch_44.ListA, dispatch_45.ListA, dispatch_46.ListA, dispatch_47.ListA, dispatch_48.ListA, dispatch_49.ListA, dispatch_50.ListA, dispatch_51.ListA, dispatch_52.ListA, dispatch_53.ListA, dispatch_54.ListA, dispatch_55.ListA, dispatch_56.ListA, dispatch_57.ListA, dispatch_58.ListA, dispatch_59.ListA, dispatch_60.ListA, dispatch_61.ListA, dispatch_62.ListA, dispatch_63.ListA, dispatch_64.ListA, dispatch_65.ListA, dispatch_66.ListA, dispatch_67.ListA, dispatch_68.ListA, dispatch_69.ListA, dispatch_70.ListA, dispatch_71.ListA, dispatch_72.ListA, dispatch_73.ListA, dispatch_74.ListA, dispatch_75.ListA, dispatch_76.ListA, dispatch_77.ListA, dispatch_78.ListA, dispatch_79.ListA, dispatch_80.ListA, dispatch_81.ListA, dispatch_82.ListA, dispatch_83.ListA, dispatch_84.ListA, dispatch_85.ListA, dispatch_86.ListA, dispatch_87.ListA, dispatch_88.ListA, dispatch_89.ListA, dispatch_90.ListA, dispatch_91.ListA, dispatch_92.ListA, dispatch_93.ListA, dispatch_94.ListA, dispatch_95.ListA, dispatch_96.ListA, dispatch_97.ListA, dispatch_98.ListA, dispatch_99.ListA, dispatch_100.ListA, dispatch_101.ListA, dispatch_102.ListA, dispatch_103.ListA, dispatch_104.ListA, dispatch_105.ListA, dispatch_106.ListA, dispatch_107.ListA, dispatch_108.ListA, dispatch_109.ListA, dispatch_110.ListA, dispatch_111.ListA, dispatch_112.ListA, dispatch_113.ListA, dispatch_114.ListA])
frame = Geometry(frame_merge)
preview = CustomPreview(Geometry=frame, Material=col_3)
mounts_merge = Merge(Data1=[dispatch_116.ListA, dispatch_118.ListA, dispatch_120.ListA, dispatch_122.ListA, dispatch_124.ListA, dispatch_126.ListA, dispatch_128.ListA, dispatch_130.ListA, dispatch_132.ListA, dispatch_134.ListA, dispatch_136.ListA, dispatch_138.ListA, dispatch_140.ListA, dispatch_142.ListA, dispatch_144.ListA, dispatch_146.ListA])
mounts = Geometry(mounts_merge)
preview_2 = CustomPreview(Geometry=mounts, Material=col_4)
counters_merge = Merge(Data1=[dispatch.ListA, dispatch_152.ListA, dispatch_162.ListA, dispatch_172.ListA, dispatch_182.ListA, dispatch_192.ListA, dispatch_202.ListA, dispatch_212.ListA, dispatch_222.ListA])
counters = Geometry(counters_merge)
preview_3 = CustomPreview(Geometry=counters, Material=col_5)
cabinets_merge = Merge(Data1=[dispatch_2.ListA, dispatch_3.ListA, dispatch_4.ListA, dispatch_5.ListA, dispatch_6.ListA, dispatch_7.ListA, dispatch_153.ListA, dispatch_154.ListA, dispatch_155.ListA, dispatch_156.ListA, dispatch_157.ListA, dispatch_158.ListA, dispatch_163.ListA, dispatch_164.ListA, dispatch_165.ListA, dispatch_166.ListA, dispatch_167.ListA, dispatch_168.ListA, dispatch_173.ListA, dispatch_174.ListA, dispatch_175.ListA, dispatch_176.ListA, dispatch_177.ListA, dispatch_178.ListA, dispatch_183.ListA, dispatch_184.ListA, dispatch_185.ListA, dispatch_186.ListA, dispatch_187.ListA, dispatch_188.ListA, dispatch_193.ListA, dispatch_194.ListA, dispatch_195.ListA, dispatch_196.ListA, dispatch_197.ListA, dispatch_198.ListA, dispatch_203.ListA, dispatch_204.ListA, dispatch_205.ListA, dispatch_206.ListA, dispatch_207.ListA, dispatch_208.ListA, dispatch_213.ListA, dispatch_214.ListA, dispatch_215.ListA, dispatch_216.ListA, dispatch_217.ListA, dispatch_218.ListA, dispatch_223.ListA, dispatch_224.ListA, dispatch_225.ListA, dispatch_226.ListA, dispatch_227.ListA, dispatch_228.ListA])
cabinets = Geometry(cabinets_merge)
preview_4 = CustomPreview(Geometry=cabinets, Material=col_6)
shelves_merge = Merge(Data1=[dispatch_8.ListA, dispatch_159.ListA, dispatch_169.ListA, dispatch_179.ListA, dispatch_189.ListA, dispatch_199.ListA, dispatch_209.ListA, dispatch_219.ListA, dispatch_229.ListA])
shelves = Geometry(shelves_merge)
preview_5 = CustomPreview(Geometry=shelves, Material=col_7)
back_panels_merge = Merge(Data1=[dispatch_9.ListA, dispatch_160.ListA, dispatch_170.ListA, dispatch_180.ListA, dispatch_190.ListA, dispatch_200.ListA, dispatch_210.ListA, dispatch_220.ListA, dispatch_230.ListA])
back_panels = Geometry(back_panels_merge)
preview_6 = CustomPreview(Geometry=back_panels, Material=col_8)
signs_merge = Merge(Data1=[dispatch_147.ListA, dispatch_149.ListA, dispatch_151.ListA])
signs = Geometry(signs_merge)
preview_7 = CustomPreview(Geometry=signs, Material=col_9)
casters_merge = Merge(Data1=place_vendor_casters.Geometry)
casters = Geometry(casters_merge)
preview_8 = CustomPreview(Geometry=casters, Material=col_10)
module_sizes_xyz_width_depth_counter_hei = Merge(Data1=[dispatch_10.ListA, dispatch_161.ListA, dispatch_171.ListA, dispatch_181.ListA, dispatch_191.ListA, dispatch_201.ListA, dispatch_211.ListA, dispatch_221.ListA, dispatch_231.ListA])  # "MODULE SIZES XYZ = width depth counter height"
